# Grasshopper definition 01_planning_undulating_wall.gh (Grasshopper 1.0.7)
# plug-ins: Pufferfish

# ----
# BUILDING BLOCK
number_slider = Slider(0.025, range=0..0.1)
center_box = CenterBox(Base=PlaneXY(0, 0, 0), X=number_slider, Y=Slider(0.008, range=0..0.1), Z=Slider(0.005, range=0..0.1))

geometry = Geometry(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)
geometry_2 = Geometry(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)
mesh_brep = MeshBrep(
    Brep=geometry_2,
    Settings={GridMaxCount=0, GridMinCount=16, JaggedSeams=False, MaxEdgeLength=0, MinEdgeLength=0.0001, MinTolerance=0, Refine=True, RefineAngle=0, RelativeTolerance=0.65, SimplePlanes=True, Tolerance=0})
mesh_brep_2 = MeshBrep(
    Brep=geometry,
    Settings={GridMaxCount=0, GridMinCount=16, JaggedSeams=False, MaxEdgeLength=0, MinEdgeLength=0.0001, MinTolerance=0, Refine=True, RefineAngle=0, RelativeTolerance=0.65, SimplePlanes=True, Tolerance=0})
point = Point(Point(0.3256446368, 0.2591018316, 0.02418378874))
# TRANSFORM A<->B
transformation_from_a_to_b = GhPythonScript()  # -> a_2_b, b_2_a
# ---------- transformation_from_a_to_b: Python ----------
import Rhino.Geometry as rg
import math

# Transformation matrix inputs
x = 0.5347479398223676
y = -0.7939334915306736
z = 0.0007630697140932686
r = 0.00801613165265005  # Roll
p = -0.0064154595608891625 # Pitch
yaw = 3.133456800610911  # Yaw

# Compute rotation matrix
cos_r, sin_r = math.cos(r), math.sin(r)
cos_p, sin_p = math.cos(p), math.sin(p)
cos_y, sin_y = math.cos(yaw), math.sin(yaw)

# Rotation matrix components
m00 = cos_y * cos_p
m01 = cos_y * sin_p * sin_r - sin_y * cos_r
m02 = cos_y * sin_p * cos_r + sin_y * sin_r
m10 = sin_y * cos_p
m11 = sin_y * sin_p * sin_r + cos_y * cos_r
m12 = sin_y * sin_p * cos_r - cos_y * sin_r
m20 = -sin_p
m21 = cos_p * sin_r
m22 = cos_p * cos_r

# Create Rhino Transform object
rotation_matrix = rg.Transform.Identity
rotation_matrix.M00 = m00
rotation_matrix.M01 = m01
rotation_matrix.M02 = m02
rotation_matrix.M10 = m10
rotation_matrix.M11 = m11
rotation_matrix.M12 = m12
rotation_matrix.M20 = m20
rotation_matrix.M21 = m21
rotation_matrix.M22 = m22

# Add translation
rotation_matrix.M03 = x
rotation_matrix.M13 = y
rotation_matrix.M23 = z


# Compute inverse
success, inverse_matrix = rg.Transform.TryGetInverse(rotation_matrix)

# Output
a_2_b = rotation_matrix
b_2_a = inverse_matrix if success else None  # Return None if inversion fails
# ---------- end transformation_from_a_to_b ----------
transform = Transform(Geometry=point, Transform=transformation_from_a_to_b.a_2_b)

# ----
# DESIGN
number_slider_2 = Slider(0.015, range=0..0.1)
unit_z = UnitZ(Factor=number_slider_2)
curve = Curve(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)
number_slider_3 = Slider(0.053, range=0..0.1)
move = Move(Geometry=curve, Motion=unit_z)  # -> Geometry, Transform
divide_distance = DivideDistance(Curve=move.Geometry, Distance=number_slider_3)  # -> Points, Tangents, Parameters
series = Series(Start=0, Step=Slider(0.01, range=0..0.01), Count=Slider(5, range=0..10))
panel = Panel("""True
False""")
unit_z_2 = UnitZ(Factor=1)
unit_z_3 = UnitZ(Factor=series)
cross_product = CrossProduct(VectorA=divide_distance.Tangents, VectorB=unit_z_2, Unitize=True)  # -> Vector, Length
division = Division(A=number_slider_3, B=2)
move_2 = Move(Geometry=move.Geometry, Motion=unit_z_3)  # -> Geometry, Transform
dispatch = Dispatch(List=move_2.Geometry, DispatchPattern=panel)  # -> ListA, ListB
divide_distance_2 = DivideDistance(Curve=dispatch.ListA, Distance=division)  # -> Points, Tangents, Parameters
divide_distance_3 = DivideDistance(Curve=dispatch.ListB, Distance=division)  # -> Points, Tangents, Parameters
construct_plane = ConstructPlane(Origin=divide_distance.Points, XAxis=cross_product.Vector, YAxis=divide_distance.Tangents)
vector_display = VectorDisplay(Anchor=divide_distance.Points, Vector=cross_product.Vector)
panel_2 = Panel("""True
False""")
orient = Orient(Geometry=center_box, Source=PlaneXY(0, 0, 0), Target=construct_plane)  # -> Geometry, Transform
cull_pattern = CullPattern(List=divide_distance_3.Points, CullPattern=invert(panel_2))
cull_pattern_2 = CullPattern(List=divide_distance_3.Tangents, CullPattern=invert(panel_2))
cull_pattern_3 = CullPattern(List=divide_distance_2.Tangents, CullPattern=panel_2)
cull_pattern_4 = CullPattern(List=divide_distance_2.Points, CullPattern=panel_2)
unit_z_4 = UnitZ(Factor=1)
unit_z_5 = UnitZ(Factor=1)
cross_product_2 = CrossProduct(VectorA=cull_pattern_3, VectorB=unit_z_4, Unitize=True)  # -> Vector, Length
cross_product_3 = CrossProduct(VectorA=cull_pattern_3, VectorB=unit_z_5, Unitize=True)  # -> Vector, Length
construct_plane_2 = ConstructPlane(Origin=cull_pattern, XAxis=cull_pattern_2, YAxis=cross_product_2.Vector)
construct_plane_3 = ConstructPlane(Origin=cull_pattern_4, XAxis=cull_pattern_3, YAxis=cross_product_3.Vector)
orient_2 = Orient(Geometry=center_box, Source=PlaneXY(0, 0, 0), Target=construct_plane_2)  # -> Geometry, Transform
orient_3 = Orient(Geometry=center_box, Source=PlaneXY(0, 0, 0), Target=construct_plane_3)  # -> Geometry, Transform

# ----
# ELEMENTS
planes = Plane(construct_plane)
point_list = PointList(Points=planes, Size=Slider(0.01, range=0..0.01))
list_item = ListItem(List=planes, Index=0, Wrap=True)  # -> Item, Item1, Item2, Item3, Item4, Item5, Item6, Item7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
point_2 = Point(transform)

# ----
# pick plane
xy_plane = XYPlane(Origin=point)
flip_plane = FlipPlane(Plane=xy_plane, FlipX=False, FlipY=False, FlipZ=True)  # -> Flipped, ResultBoolean

# ----
# approach pick plane
# PLACE ROBOT A
number_slider_4 = Slider(0.08, range=0..1)
unit_z_6 = UnitZ(Factor=number_slider_4)
move_3 = Move(Geometry=flip_plane.Flipped, Motion=unit_z_6)  # -> Geometry, Transform

info = Info()  # -> info
#   port info: Environment info.
# ---------- info: Python ----------
"""
Displays information about the active COMPAS environment.
"""
import compas_bootstrapper
from ghpythonlib.componentbase import executingcomponent as component

import compas
import compas_fab


class CompasInfo(component):
    def RunScript(self):
        self.Message = 'COMPAS v{}'.format(compas.__version__)
        info = 'COMPAS Version: {}\nEnvironment: {}\nCOMPAS FAB Version:{}'
        return (info.format(compas.__version__, compas_bootstrapper.ENVIRONMENT_NAME,compas_fab.__version__))
# ---------- end info ----------

# ----
# pick plane
xy_plane_2 = XYPlane(Origin=point_2)
flip_plane_2 = FlipPlane(Plane=xy_plane_2, FlipX=False, FlipY=False, FlipZ=True)  # -> Flipped, ResultBoolean

# ----
# approach pick plane
# PLACE ROBOT B
number_slider_5 = Slider(0.08, range=0..1)
unit_z_7 = UnitZ(Factor=number_slider_5)
move_4 = Move(Geometry=flip_plane_2.Flipped, Motion=unit_z_7)  # -> Geometry, Transform

# ----
# Load Robot
connect = BooleanToggle(True)
ros_connect = ROSConnect(connect=connect)  # -> ros_client, is_connected; inputs port: Int32, connect: Boolean
#   port ip: The ip address ROS. Defaults to 127.0.0.1.
#   port port: The port of ROS. Defaults to 9090.
#   port connect: If True, connects to ROS. If False, disconnects from ROS. Defaults to False.
#   port ros_client: The ROS client.
#   port is_connected: True if connection established.
# ---------- ros_connect: Python ----------
"""
Connect or disconnect to ROS.

COMPAS FAB v0.27.0
"""
from ghpythonlib.componentbase import executingcomponent as component
from scriptcontext import sticky as st

from compas_fab.backends import RosClient
from compas_fab.ghpython.components import create_id


class ROSConnect(component):
    def RunScript(self, ip, port, connect):
        ros_client = None

        ip = ip or '127.0.0.1'
        port = port or 9090

        key = create_id(self, 'ros_client')
        ros_client = st.get(key, None)

        if ros_client:
            st[key].close()
        if connect:
            st[key] = RosClient(ip, port)
            st[key].run(5)

        ros_client = st.get(key, None)
        is_connected = ros_client.is_connected if ros_client else False
        return (ros_client, is_connected)
# ---------- end ros_connect ----------
load_robot = BooleanToggle(True)
ros_robot = ROSRobot(ros_client=ros_connect.ros_client, load=load_robot)  # -> robot; inputs load: Boolean
#   port ros_client: The ROS client.
#   port load: If True, loads the robot from ROS. Defaults to False.
# ---------- ros_robot: Python ----------
"""
Load robot directly from ROS.

COMPAS FAB v0.27.0
"""
from compas_ghpython.artists import RobotModelArtist
from ghpythonlib.componentbase import executingcomponent as component
from scriptcontext import sticky as st

from compas_fab.ghpython.components import create_id


class ROSRobot(component):
    def RunScript(self, ros_client, load):
        key = create_id(self, 'robot')

        if ros_client and ros_client.is_connected and load:
            # Load URDF from ROS
            st[key] = ros_client.load_robot(load_geometry=True, precision='12f')
            st[key].artist = RobotModelArtist(st[key].model)

        robot = st.get(key, None)
        if robot:  # client sometimes need to be restarted, without needing to reload geometry
            robot.client = ros_client
        return robot
# ---------- end ros_robot ----------

# ----
# SCENE
planning_scene = PlanningScene(robot=ros_robot)  # -> scene
#   port scene: A planning scene.
# ---------- planning_scene: Python ----------
"""
Create a planning scene.

COMPAS FAB v0.27.0
"""
from ghpythonlib.componentbase import executingcomponent as component
from scriptcontext import sticky as st

from compas_fab.ghpython.components import create_id
from compas_fab.robots import PlanningScene


class PlanningSceneComponent(component):
    def RunScript(self, robot):
        key = create_id(self, 'planning_scene')
        if robot:
            st[key] = PlanningScene(robot)
        return st.get(key, None)
# ---------- end planning_scene ----------

# ----
# ROBOT
# ZERO Configs
panel_3 = Panel("robot_A")
zero_config = ZeroConfig(robot=ros_robot, group=panel_3)  # -> config
#   port group: If assigned, it will return the zero configuration for the given group, otherwise a full zero configuration.
#   port config: The zero configuration.
# ---------- zero_config: Python ----------
"""
Get a zero configuration for a robot.

COMPAS FAB v0.27.0
"""
from ghpythonlib.componentbase import executingcomponent as component


class ConfigZero(component):
    def RunScript(self, robot, group):

        if robot:
            return robot.zero_configuration(group)

        return None
# ---------- end zero_config ----------
zero_config_2 = ZeroConfig(robot=ros_robot)  # -> config; same code as zero_config
zero_config_3 = ZeroConfig(robot=ros_robot, group="robot_B")  # -> config; same code as zero_config

collision_mesh = CollisionMesh(
    scene=planning_scene,
    mesh=mesh_brep,
    identifier="obstacle",
    add=Toggle(True),
    append=Toggle(False),
    remove=Toggle(False))  # -> ok; inputs mesh: Mesh, add: Boolean, append: Boolean, remove: Boolean
#   port scene: The planning scene.
#   port mesh: A collision mesh.
#   port identifier: The identifier of the collision mesh.
#   port add: If True, adds the collision mesh to the planning scene.
#   port append: If True, appends the collision mesh to the planning scene.
#   port remove: If True, removes the collision mesh from the planning scene.
#   port ok: True if the operation was successfully performed.
# ---------- collision_mesh: Python ----------
"""
Add or remove a collision mesh from the planning scene.

COMPAS FAB v0.27.0
"""
from compas_rhino.geometry import RhinoMesh
from ghpythonlib.componentbase import executingcomponent as component

from compas_fab.robots import CollisionMesh


class CollisionMeshComponent(component):
    def RunScript(self, scene, M, name, add, append, remove):
        ok = False
        self.Message = ""

        if (add and append) or (append and remove) or (add and remove):
            self.Message = "Use only one operation at a time\n(add, append or remove)"
            raise Exception(self.Message)

        if scene and M and name:
            mesh = RhinoMesh.from_geometry(M).to_compas()
            collision_mesh = CollisionMesh(mesh, name)
            if add:
                scene.add_collision_mesh(collision_mesh)
                self.Message = "Added"
                ok = True
            if append:
                scene.append_collision_mesh(collision_mesh)
                self.Message = "Appended"
                ok = True
            if remove:
                scene.remove_collision_mesh(name)
                self.Message = "Removed"
                ok = True
        return ok
# ---------- end collision_mesh ----------
collision_mesh_2 = CollisionMesh(
    scene=planning_scene,
    mesh=mesh_brep_2,
    identifier="robot_table",
    add=Toggle(True),
    append=Toggle(False),
    remove=Toggle(False))  # -> ok; inputs mesh: Mesh, add: Boolean, append: Boolean, remove: Boolean; same code as collision_mesh
# Package Version: COMPAS Version: 1.17.10
# Environment: design6197
# COMPAS FAB Version:0.27.0
your_version = Panel(info)

# ----
# place plane
flip_plane_3 = FlipPlane(Plane=list_item.Item1, FlipX=False, FlipY=False, FlipZ=True)  # -> Flipped, ResultBoolean

# ----
# approach place plane
number_slider_6 = Slider(0.05, range=0..1)
unit_z_8 = UnitZ(Factor=number_slider_6)
move_5 = Move(Geometry=flip_plane_3.Flipped, Motion=unit_z_8)  # -> Geometry, Transform

# ----
# place plane
flip_plane_4 = FlipPlane(Plane=list_item.Item8, FlipX=False, FlipY=False, FlipZ=True)  # -> Flipped, ResultBoolean

# ----
# approach place plane
number_slider_7 = Slider(0.05, range=0..1)
unit_z_9 = UnitZ(Factor=number_slider_7)
move_6 = Move(Geometry=flip_plane_4.Flipped, Motion=unit_z_9)  # -> Geometry, Transform

number_slider_8 = Slider(45, range=-360..360)
gripper_lowpoly = Mesh(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)

# ----
# Labeled Robots
labels = Geometry([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])

rotate = Rotate(Geometry=gripper_lowpoly, Angle=degrees(number_slider_8), Plane=PlaneXY(0, 0, 0))  # -> Geometry, Transform
zero_config_4 = ZeroConfig(robot=ros_robot)  # -> config; same code as zero_config
panel_4 = Panel(zero_config_4)

# ----
# TOOL attachment
number_slider_9 = Slider(0.102, range=0..1)
unit_z_10 = UnitZ(Factor=number_slider_9)
xy_plane_3 = XYPlane(Origin=Point(0, 0, 0))
move_7 = Move(Geometry=xy_plane_3, Motion=unit_z_10)  # -> Geometry, Transform
gripper = Mesh(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)

rotate_2 = Rotate(Geometry=move_7.Geometry, Angle=degrees(number_slider_8), Plane=PlaneXY(0, 0, 0))  # -> Geometry, Transform
rotate_3 = Rotate(Geometry=gripper, Angle=degrees(number_slider_8), Plane=PlaneXY(0, 0, 0))  # -> Geometry, Transform

transform_2 = Transform(Geometry=rotate.Geometry, Transform=transformation_from_a_to_b.a_2_b)
tool = AttachedTool(robot=ros_robot, visual_mesh=rotate_3.Geometry, collision_mesh=transform_2, tcf_plane=rotate_2.Geometry, group="robot_B")  # -> robot; inputs visual_mesh: Mesh, collision_mesh: Mesh
#   port visual_mesh: A visual mesh for the tool.
#   port collision_mesh: A collision mesh for the tool.
#   port tcf_plane: The frame of the tool in tool0 frame.
#   port group: The planning group to which the tool should be attached.
# ---------- tool: Python ----------
"""
Attach a tool to the robot.

COMPAS FAB v0.27.0
"""
from ghpythonlib.componentbase import executingcomponent as component
from compas_rhino.conversions import RhinoMesh
from compas_rhino.conversions import plane_to_compas_frame

from compas.geometry import Frame
from compas_fab.robots import Tool


class AttachToolComponent(component):
    def RunScript(self, robot, visual_mesh, collision_mesh, tcf_plane, group):
        if robot and robot.client and robot.client.is_connected and visual_mesh:
            if not collision_mesh:
                collision_mesh = visual_mesh

            c_visual_mesh = RhinoMesh.from_geometry(visual_mesh).to_compas()
            c_collision_mesh = RhinoMesh.from_geometry(collision_mesh).to_compas()

            if not tcf_plane:
                frame = Frame.worldXY()
            else:
                frame = plane_to_compas_frame(tcf_plane)
            tool = Tool(c_visual_mesh, frame, c_collision_mesh)

            robot.attach_tool(tool, group)

        return robot
# ---------- end tool ----------

tool_2 = AttachedTool(
    robot=ros_robot,
    visual_mesh=rotate_3.Geometry,
    collision_mesh=rotate.Geometry,
    tcf_plane=rotate_2.Geometry,
    group="robot_A")  # -> robot; inputs visual_mesh: Mesh, collision_mesh: Mesh; same code as tool

# ----
# place config
inverse_kinematics = InverseKinematics(robot=tool, plane=flip_plane_4.Flipped, group="robot_B")  # -> configuration
#   port plane: The plane or frame to calculate the inverse kinematic for.
#   port start_configuration: If passed, calculates the inverse such that the joint positions differ the least from the start_configuration. Defaults to the zero configuration.
#   port group: The planning group used for calculation. Defaults to the robot's main planning group.
#   port configuration: The planning group's configuration.
# ---------- inverse_kinematics: Python ----------
"""
Calculate the robot's inverse kinematic for a given plane.

COMPAS FAB v0.27.0
"""
from compas_rhino.conversions import RhinoPlane
from ghpythonlib.componentbase import executingcomponent as component


class InverseKinematics(component):
    def RunScript(self, robot, plane, start_configuration, group):
        configuration = None
        if robot and robot.client and robot.client.is_connected and plane:
            frame = RhinoPlane.from_geometry(plane).to_compas_frame()
            configuration = robot.inverse_kinematics(frame, start_configuration, group)
        return configuration
# ---------- end inverse_kinematics ----------

robot_visualize = RobotVisualize(robot=tool, configuration=zero_config_4)  # -> visual, collision, collision_meshes, attached_meshes, frames, base_frame, ee_frame; inputs show_visual: Boolean, show_collision: Boolean, show_frames: Boolean, show_base_frame: Boolean, show_end_effector_frame: Boolean, show_cm: Boolean, show_acm: Boolean
#   port group: The planning group used for end-effector and base visualization.
#   port configuration: The robot's full configuration.
#   port show_visual: Whether or not to show the robot's visual meshes.
#   port show_collision: Whether or not to show the robot's collision meshes.
#   port show_frames: Whether or not to show the robot's joint frames.
#   port show_base_frame: Whether or not to show the robot's base frame.
#   port show_end_effector_frame: Whether or not to show the robot's end-effector frame.
#   port show_cm: Whether or not to show the collision meshes (if any).
#   port show_acm: Whether or not to show the attached collision meshes (if any).
#   port visual: Rhino meshes of the robot's visual geometry (if any).
#   port collision: Rhino meshes of the robot's collision geometry (if any).
#   port collision_meshes: Rhino meshes of the scene's collision meshes (if any).
#   port attached_meshes: Rhino meshes of the scene's attached collision meshes (if any).
#   port frames: The robot's joint frames as Rhino planes (if any).
#   port base_frame: The robot's base frame as a Rhino plane (if any).
#   port ee_frame: The robot's end-effector frame as a Rhino plane (if any).
# ---------- robot_visualize: Python ----------
"""
Visualizes the robot.

COMPAS FAB v0.27.0
"""
from compas.artists import Artist
from compas.geometry import Frame
from compas.geometry import Transformation
from compas_fab.robots import PlanningScene
from ghpythonlib.componentbase import executingcomponent as component


class RobotVisualize(component):
    def RunScript(
        self,
        robot,
        group,
        configuration,
        show_visual,
        show_collision,
        show_frames,
        show_base_frame,
        show_end_effector_frame,
        show_cm,
        show_acm,
    ):

        visual = None
        collision = None
        collision_meshes = None
        attached_meshes = None
        frames = None
        base_frame = None
        ee_frame = None

        if robot:
            show_visual = True if show_visual is None else show_visual
            show_cm = True if show_cm is None else show_cm
            show_acm = True if show_acm is None else show_acm
            configuration = configuration or robot.zero_configuration()

            robot.update(configuration, visual=show_visual, collision=show_collision)
            compas_frames = robot.transformed_frames(configuration, group)

            if show_visual:
                visual = robot.artist.draw_visual()

            if show_collision:
                collision = robot.artist.draw_collision()

            if show_base_frame:
                base_compas_frame = compas_frames[0]
                artist = Artist(base_compas_frame)
                base_frame = artist.draw()

            if show_end_effector_frame:
                ee_compas_frame = robot.forward_kinematics(
                    configuration, group, options=dict(solver="model")
                )
                artist = Artist(ee_compas_frame)
                ee_frame = artist.draw()

            if show_frames:
                frames = []
                for compas_frame in compas_frames[1:]:
                    artist = Artist(compas_frame)
                    frame = artist.draw()
                    frames.append(frame)

            if show_cm or show_acm:
                scene = PlanningScene(robot)
                scene = robot.client.get_planning_scene()

                collision_meshes = []
                attached_meshes = []

                if show_cm:
                    for co in scene.world.collision_objects:
                        header = co.header
                        frame_id = header.frame_id
                        cms = co.to_collision_meshes()

                        for cm in cms:
                            if cm.frame != Frame.worldXY():
                                t = Transformation.from_frame(cm.frame)
                                mesh = cm.mesh.transformed(t)
                            else:
                                mesh = cm.mesh

                            collision_meshes.append(Artist(mesh).draw())

                if show_acm:
                    for aco in scene.robot_state.attached_collision_objects:
                        for acm in aco.to_attached_collision_meshes():
                            frame_id = aco.object["header"]["frame_id"]
                            frame = robot.forward_kinematics(
                                configuration, options=dict(link=frame_id)
                            )
                            t = Transformation.from_frame(frame)

                            # Local CM frame
                            if (
                                acm.collision_mesh.frame
                                and acm.collision_mesh.frame != Frame.worldXY()
                            ):
                                t = t * Transformation.from_frame(
                                    acm.collision_mesh.frame
                                )

                            mesh = acm.collision_mesh.mesh.transformed(t)

                            attached_meshes.append(Artist(mesh).draw())

        return (
            visual,
            collision,
            collision_meshes,
            attached_meshes,
            frames,
            base_frame,
            ee_frame,
        )
# ---------- end robot_visualize ----------

unit_z_11 = UnitZ(Factor=number_slider_9)
mesh_brep_3 = MeshBrep(
    Brep=center_box,
    Settings={GridMaxCount=0, GridMinCount=16, JaggedSeams=False, MaxEdgeLength=0, MinEdgeLength=0.0001, MinTolerance=0, Refine=True, RefineAngle=0, RelativeTolerance=0.65, SimplePlanes=True, Tolerance=0})
move_8 = Move(Geometry=mesh_brep_3, Motion=unit_z_11)  # -> Geometry, Transform
panel_5 = Panel("""robotA_tool0
robotA_link_6""")
# attached element
button = Button()
attached_collision_mesh = AttachedCollisionMesh(
    scene=planning_scene,
    mesh=move_8.Geometry,
    identifier="acm_robA",
    link_name="robotA_tool0",
    touch_links=panel_5,
    add=Toggle(False),
    remove=button)  # -> attached_collision_mesh; inputs mesh: Mesh, touch_links: list, add: Boolean, remove: Boolean
#   port scene: The planning scene.
#   port mesh: A collision mesh.
#   port identifier: The identifier of the collision mesh.
#   port link_name: The robot's link name to attach the mesh to.
#   port touch_links: Names of links that the robot is allowed to touch.
#   port add: If True, adds the collision mesh to the planning scene.
#   port remove: If True, removes the collision mesh from the planning scene.
#   port attached_collision_mesh: A collision mesh that is attached to a robot's link.
# ---------- attached_collision_mesh: Python ----------
"""
Add an attached collision mesh to the robot.

COMPAS FAB v0.27.0
"""
from ghpythonlib.componentbase import executingcomponent as component

from compas_rhino.geometry import RhinoMesh
from compas_fab.robots import AttachedCollisionMesh
from compas_fab.robots import CollisionMesh


class AttachedCollisionMeshComponent(component):
    def RunScript(self, scene, mesh, identifier, link_name, touch_links, add, remove):
        attached_collision_mesh = None
        if scene and mesh and identifier and link_name:
            compas_mesh = RhinoMesh.from_geometry(mesh).to_compas()
            collision_mesh = CollisionMesh(compas_mesh, identifier)
            attached_collision_mesh = AttachedCollisionMesh(collision_mesh, link_name, touch_links)
            if add:
                scene.add_attached_collision_mesh(attached_collision_mesh)
            if remove:
                scene.remove_attached_collision_mesh(identifier)
                scene.remove_collision_mesh(identifier)
        return attached_collision_mesh
# ---------- end attached_collision_mesh ----------

unit_z_12 = UnitZ(Factor=number_slider_9)
mesh_brep_4 = MeshBrep(
    Brep=center_box,
    Settings={GridMaxCount=0, GridMinCount=16, JaggedSeams=False, MaxEdgeLength=0, MinEdgeLength=0.0001, MinTolerance=0, Refine=True, RefineAngle=0, RelativeTolerance=0.65, SimplePlanes=True, Tolerance=0})
move_9 = Move(Geometry=mesh_brep_4, Motion=unit_z_12)  # -> Geometry, Transform
panel_6 = Panel("""robotB_tool0
robotB_link_6""")
attached_collision_mesh_2 = AttachedCollisionMesh(
    scene=planning_scene,
    mesh=move_9.Geometry,
    identifier="acm_robB",
    link_name="robotB_tool0",
    touch_links=panel_6,
    add=Toggle(False),
    remove=Button())  # -> attached_collision_mesh; inputs mesh: Mesh, touch_links: list, add: Boolean, remove: Boolean
#   port scene: The planning scene.
#   port mesh: A collision mesh.
#   port identifier: The identifier of the collision mesh.
#   port link_name: The robot's link name to attach the mesh to.
#   port touch_links: Names of links that the robot is allowed to touch.
#   port add: If True, adds the collision mesh to the planning scene.
#   port remove: If True, removes the collision mesh from the planning scene.
#   port attached_collision_mesh: A collision mesh that is attached to a robot's link.
# ---------- attached_collision_mesh_2: Python ----------
"""
Add an attached collision mesh to the robot.

COMPAS FAB v0.27.0
"""
from ghpythonlib.componentbase import executingcomponent as component

from compas_rhino.geometry import RhinoMesh
from compas_fab.robots import AttachedCollisionMesh
from compas_fab.robots import CollisionMesh


class AttachedCollisionMeshComponent(component):
    def RunScript(self, scene, mesh, identifier, link_name, touch_links, add, remove):
        attached_collision_mesh = None
        print scene
        if scene and mesh and identifier and link_name:
            compas_mesh = RhinoMesh.from_geometry(mesh).to_compas()
            print compas_mesh
            collision_mesh = CollisionMesh(compas_mesh, identifier)
            attached_collision_mesh = AttachedCollisionMesh(collision_mesh, link_name, touch_links)
            if add:
                scene.add_attached_collision_mesh(attached_collision_mesh)
            if remove:
                scene.remove_attached_collision_mesh(identifier)
                scene.remove_collision_mesh(identifier)
        return attached_collision_mesh
# ---------- end attached_collision_mesh_2 ----------

# ----
# PICK ROBOT A
orient_4 = Orient(Geometry=center_box, Source=PlaneXY(0, 0, 0), Target=flip_plane.Flipped)  # -> Geometry, Transform

# ----
# place config
inverse_kinematics_2 = InverseKinematics(robot=tool_2, plane=flip_plane_3.Flipped, group="robot_A")  # -> configuration; same code as inverse_kinematics

# ----
# approach place config
inverse_kinematics_3 = InverseKinematics(robot=tool_2, plane=move_5.Geometry, group="robot_A")  # -> configuration; same code as inverse_kinematics

# ----
# approach pick config
inverse_kinematics_4 = InverseKinematics(robot=tool_2, plane=move_3.Geometry, group="robot_A")  # -> configuration; same code as inverse_kinematics
# MOTION PLANNING A
merge_config = MergeConfig(config_a=inverse_kinematics_4, config_b=zero_config_3)  # -> config
#   port config_a: The configuration to use as base for the merge.
#   port config_b: The configuration used to merge into the base one.
#   port config: The merged configuration.
# ---------- merge_config: Python ----------
"""
Merge two configurations.

COMPAS FAB v0.27.0
"""
from ghpythonlib.componentbase import executingcomponent as component


class ConfigMerge(component):
    def RunScript(self, config_a, config_b):

        if config_a and config_b:
            return config_a.merged(config_b)

        return None
# ---------- end merge_config ----------

# ----
# pick config
inverse_kinematics_5 = InverseKinematics(robot=tool_2, plane=flip_plane.Flipped, start_configuration=merge_config, group="robot_A")  # -> configuration; same code as inverse_kinematics

panel_7 = Panel(inverse_kinematics_5)
robot_visualize_2 = RobotVisualize(robot=tool_2, group="robot_A", configuration=inverse_kinematics_5)  # -> visual, collision, collision_meshes, attached_meshes, frames, base_frame, ee_frame; inputs show_visual: Boolean, show_collision: Boolean, show_frames: Boolean, show_base_frame: Boolean, show_end_effector_frame: Boolean, show_cm: Boolean, show_acm: Boolean; same code as robot_visualize

constraints_from_target_configuration = ConstraintsFromTargetConfiguration(robot=tool_2, target_configuration=inverse_kinematics_3, group="robot_A")  # -> constraints
#   port target_configuration: The target configuration.
#   port tolerance_above: The tolerances above the targeted joint value of each configurable joint, defining the upper bound in radians/meters to be achieved.
#   port tolerance_below: The tolerances below the targeted joint value of each configurable joint, defining the lower bound in radians/meters to be achieved.
#   port group: The planning group for which we specify the constraint. Defaults to the robot's main planning group.
#   port constraints: A list joint constraints in radians/meters.
# ---------- constraints_from_target_configuration: Python ----------
"""
Create joint constraints for each of the robot's configurable joints based on a given target configuration.

COMPAS FAB v0.27.0
"""
import math

from ghpythonlib.componentbase import executingcomponent as component


class ConstraintsFromTargetConfiguration(component):

    DEFAULT_TOLERANCE_METERS = .001
    DEFAULT_TOLERANCE_RADIANS = math.radians(1)

    def RunScript(self, robot, target_configuration, tolerance_above, tolerance_below, group):
        if robot and target_configuration:
            tolerance_above = tolerance_above or self._generate_default_tolerances(robot.get_configurable_joints(group))
            tolerance_below = tolerance_below or self._generate_default_tolerances(robot.get_configurable_joints(group))

            constraints = robot.constraints_from_configuration(
                configuration=target_configuration,
                tolerances_above=tolerance_above,
                tolerances_below=tolerance_below,
                group=group
            )

            return constraints

    def _generate_default_tolerances(self, joints):
        return [
            self.DEFAULT_TOLERANCE_METERS if j.is_scalable()
            else self.DEFAULT_TOLERANCE_RADIANS
            for j in joints
        ]
# ---------- end constraints_from_target_configuration ----------
# trajectory
boolean_toggle = BooleanToggle(True)
plan_motion = PlanMotion(
    robot=tool_2,
    goal_constraints=constraints_from_target_configuration,
    start_configuration=merge_config,
    group="robot_A",
    attached_collision_meshes=attached_collision_mesh,
    compute=boolean_toggle)  # -> trajectory; inputs goal_constraints: list, attached_collision_meshes: list, path_constraints: list, compute: Boolean
#   port goal_constraints: The goal to be achieved, defined in a set of constraints. Constraints can be very specific, for example defining value domains for each joint, such that the goal configuration is included, or defining a volume in space, to which a specific robot link (e.g. the end-effector) is required to move to.
#   port start_configuration: The robot's full configuration, i.e. values for all configurable joints of the entire robot, at the starting position. Defaults to the all-zero configuration.
#   port group: The planning group used for calculation. Defaults to the robot's main planning group.
#   port attached_collision_meshes: A list of attached collision meshes to be included for planning.
#   port path_constraints: Optional constraints that can be imposed along the solution path. Note that path calculation won't work if the start_configuration violates these constraints. Defaults to None.
#   port planner_id: The name of the algorithm used for path planning. Defaults to 'RRTConnect'
#   port compute: If True, calculates a trajectory.
#   port trajectory: The calculated trajectory.
# ---------- plan_motion: Python ----------
"""
Calculate a motion path.

COMPAS FAB v0.27.0
"""
from ghpythonlib.componentbase import executingcomponent as component
from scriptcontext import sticky as st

from compas_fab.ghpython.components import create_id


class PlanMotion(component):
    def RunScript(self, robot, goal_constraints, start_configuration, group, attached_collision_meshes, path_constraints, planner_id, compute):

        key = create_id(self, 'trajectory')

        path_constraints = list(path_constraints) if path_constraints else None
        attached_collision_meshes = list(attached_collision_meshes) if attached_collision_meshes else None
        planner_id = str(planner_id) if planner_id else 'RRTConnect'

        if robot and robot.client and robot.client.is_connected and start_configuration and goal_constraints and compute:
            st[key] = robot.plan_motion(goal_constraints,
                                        start_configuration=start_configuration,
                                        group=group,
                                        options=dict(
                                            attached_collision_meshes=attached_collision_meshes,
                                            path_constraints=path_constraints,
                                            planner_id=planner_id,
                                        ))

        trajectory = st.get(key, None)
        return trajectory
# ---------- end plan_motion ----------
trajectory_visualize = TrajectoryVisualize(robot=tool_2, group="robot_A", trajectory=plan_motion)  # -> start_configuration, configurations, fraction, time, planes, P, V, A
#   port group: The planning group for which this trajectory was planned.
#   port trajectory: The calculated trajectory.
#   port start_configuration: The start configuration of the trajectory.
#   port configurations: The full configurations along the trajectory.
#   port fraction: Indicates the fraction of requested trajectory that was calculated, e.g. 1 means the full trajectory was found.
#   port time: The time which is needed to execute that trajectory at full speed.
#   port planes: The planes of the robot's end-effector.
#   port P: The positions along the trajectory
#   port V: The velocities along the trajectory
#   port A: The accelerations along the trajectory
# ---------- trajectory_visualize: Python ----------
"""
Visualizes a trajectory.

COMPAS FAB v0.27.0
"""
from compas_ghpython import draw_frame
from compas_ghpython import list_to_ghtree
from ghpythonlib.componentbase import executingcomponent as component


class TrajectoryVisualize(component):
    def RunScript(self, robot, group, trajectory):
        start_configuration = None
        configurations = []
        fraction = 0.
        time = 0.

        planes = []
        positions = []
        velocities = []
        accelerations = []

        if robot and trajectory:
            group = group or robot.main_group_name

            for c in trajectory.points:
                configurations.append(robot.merge_group_with_full_configuration(c, trajectory.start_configuration, group))
                frame = robot.forward_kinematics(c, group, options=dict(solver='model'))
                planes.append(draw_frame(frame))
                positions.append(c.positions)
                velocities.append(c.velocities)
                accelerations.append(c.accelerations)

            start_configuration = trajectory.start_configuration
            fraction = trajectory.fraction
            time = trajectory.time_from_start

        P = list_to_ghtree(list(zip(*positions)))
        V = list_to_ghtree(list(zip(*velocities)))
        A = list_to_ghtree(list(zip(*accelerations)))

        # return outputs if you have them; here I try it for you:
        return (start_configuration, configurations, fraction, time, planes, P, V, A)
# ---------- end trajectory_visualize ----------

list_item_2 = ListItem(List=trajectory_visualize.configurations, Index=0, Wrap=True)
ghpython_script = GhPythonScript(robot=tool_2, conf=list_item_2, group="robot_A")  # -> out, a
# ---------- ghpython_script: Python ----------
config_A = robot.zero_configuration(group = "robot_A")

config_B = robot.zero_configuration(group = "robot_B")

rob = ""

if group == "robot_A":
    rob = "robotA"
elif group =="robot_B":
    rob = "robotB"
    
join_values= []

for n,j in zip(conf.joint_names,conf.joint_values):
    if n == str(rob)+"_joint_1":
        join_values.append(j)
for n,j in zip(conf.joint_names,conf.joint_values):
    if n == str(rob)+"_joint_2":
        join_values.append(j)
for n,j in zip(conf.joint_names,conf.joint_values):
    if n == str(rob)+"_joint_3":
        join_values.append(j)
for n,j in zip(conf.joint_names,conf.joint_values):
    if n == str(rob)+"_joint_4":
        join_values.append(j)
for n,j in zip(conf.joint_names,conf.joint_values):
    if n == str(rob)+"_joint_5":
        join_values.append(j)
for n,j in zip(conf.joint_names,conf.joint_values):
    if n == str(rob)+"_joint_6":
        join_values.append(j)

if group=="robot_A":
    config_A.joint_values = join_values
    a = config_B.merged(config_A)
elif group=="robot_B":
    config_B.joint_values = join_values
    a = config_A.merged(config_B)
# ---------- end ghpython_script ----------
merge = Merge(Data1=flatten(trajectory_visualize.configurations), Data2=flatten(ghpython_script.a))
list_length = ListLength(List=merge)
run = BooleanToggle(True)
python = PythonScript(Run=run, Target=list_length, Interval=Slider(25, range=1..1000))  # -> Counter; inputs Run: Boolean
# ---------- python: Python ----------
import Grasshopper as gh

def updateComponent(interval):
    
    """ Update this component similar to using a grasshopper timer """
    
    def callBack(e):
        ghenv.Component.ExpireSolution(False)
        
    ghenv.Component.OnPingDocument().ScheduleSolution(interval,
    gh.Kernel.GH_Document.GH_ScheduleDelegate(callBack))

Target = Target-1

# Instantiate or reset persistent counter variable
if "count" not in globals() or not Run:
    count = 0

# Update the variable and component
if Run:
    if count < Target:
        count +=1
        updateComponent(Interval)
    elif count == Target:
        count = 0

# Output counter
if count == 0:
    Counter = Target
else:
    Counter = count
# ---------- end python ----------
item = ListItem(List=merge, Index=python, Wrap=True)
panel_8 = Panel(python)
robot_visualize_3 = RobotVisualize(
    robot=tool_2,
    acm=move_8.Geometry,
    group="robot_A",
    configuration=item,
    show_frames=Toggle(False),
    show_end_effector_frame=Toggle(True),
    show_cm=Toggle(True),
    show_acm=Toggle(True),
    t0cf_2_tcp=number_slider_9)  # -> visual, collision, collision_meshes, attached_meshes, frames, base_frame, ee_frame; inputs acm: Mesh, show_visual: Boolean, show_collision: Boolean, show_frames: Boolean, show_base_frame: Boolean, show_end_effector_frame: Boolean, show_cm: Boolean, show_acm: Boolean
#   port group: The planning group used for end-effector and base visualization.
#   port configuration: The robot's full configuration.
#   port show_visual: Whether or not to show the robot's visual meshes.
#   port show_collision: Whether or not to show the robot's collision meshes.
#   port show_frames: Whether or not to show the robot's joint frames.
#   port show_base_frame: Whether or not to show the robot's base frame.
#   port show_end_effector_frame: Whether or not to show the robot's end-effector frame.
#   port show_cm: Whether or not to show the collision meshes (if any).
#   port show_acm: Whether or not to show the attached collision meshes (if any).
#   port visual: Rhino meshes of the robot's visual geometry (if any).
#   port collision: Rhino meshes of the robot's collision geometry (if any).
#   port collision_meshes: Rhino meshes of the scene's collision meshes (if any).
#   port attached_meshes: Rhino meshes of the scene's attached collision meshes (if any).
#   port frames: The robot's joint frames as Rhino planes (if any).
#   port base_frame: The robot's base frame as a Rhino plane (if any).
#   port ee_frame: The robot's end-effector frame as a Rhino plane (if any).
# ---------- robot_visualize_3: Python ----------
"""
Visualizes the robot.

COMPAS FAB v0.27.0
"""
from compas.artists import Artist
from compas.geometry import Frame
from compas.geometry import Transformation
from compas_fab.robots import PlanningScene
from ghpythonlib.componentbase import executingcomponent as component
from compas_fab.robots import AttachedCollisionMesh
import Rhino.Geometry as rg


class RobotVisualize(component):
    def RunScript(
        self,
        robot,
        acm,
        group,
        configuration,
        show_visual,
        show_collision,
        show_frames,
        show_base_frame,
        show_end_effector_frame,
        show_cm,
        show_acm,
        t0cf_2_tcp
    ):

        visual = None
        collision = None
        collision_meshes = None
        attached_meshes = None
        frames = None
        base_frame = None
        ee_frame = None

        if robot:
            show_visual = True if show_visual is None else show_visual
            show_cm = True if show_cm is None else show_cm
            show_acm = True if show_acm is None else show_acm
            configuration = configuration or robot.zero_configuration()

            robot.update(configuration, visual=show_visual, collision=show_collision)
            compas_frames = robot.transformed_frames(configuration, group)

            if show_visual:
                visual = robot.artist.draw_visual()

            if show_collision:
                collision = robot.artist.draw_collision()

            if show_base_frame:
                base_compas_frame = compas_frames[0]
                artist = Artist(base_compas_frame)
                base_frame = artist.draw()

            if show_end_effector_frame:
                ee_compas_frame = robot.forward_kinematics(
                    configuration, group, options=dict(solver="model")
                )
                artist = Artist(ee_compas_frame)
                ee_frame = artist.draw()

            if show_frames:
                frames = []
                for compas_frame in compas_frames[1:]:
                    artist = Artist(compas_frame)
                    frame = artist.draw()
                    frames.append(frame)

            if show_cm or show_acm:
                scene = PlanningScene(robot)
                scene = robot.client.get_planning_scene()

                collision_meshes = []
                attached_meshes = []

                if show_cm:
                    for co in scene.world.collision_objects:
                        header = co.header
                        frame_id = header.frame_id
                        cms = co.to_collision_meshes()

                        for cm in cms:
                            if cm.frame != Frame.worldXY():
                                t = Transformation.from_frame(cm.frame)
                                mesh = cm.mesh.transformed(t)
                            else:
                                mesh = cm.mesh

                            collision_meshes.append(Artist(mesh).draw())

                if show_acm:
                    trans = rg.Transform.PlaneToPlane(rg.Plane.WorldXY, ee_frame)
                    acm.Transform(trans)
                    vec = ee_frame.Normal
                    vec.Unitize()
                    vec *= t0cf_2_tcp
                    trans2 = rg.Transform.Translation(-vec)
                    acm.Transform(trans2)
        return (
            visual,
            collision,
            collision_meshes,
            acm,
            frames,
            base_frame,
            ee_frame,
        )
# ---------- end robot_visualize_3 ----------
mesh = Mesh(robot_visualize_3.attached_meshes)

# ----
# EXPORT
panel_9 = Panel("robotA")
approach_placing_plane_robota = Plane(flip_plane_3.Flipped)
robota_approach_place_config = Data(inverse_kinematics_3)
robota_pick_approach_config = Data(inverse_kinematics_4)
robota_place_plane = Plane(flip_plane_3.Flipped)
export = Button()
robota_pickup_plane = Plane(flip_plane.Flipped)
concatenate = Concatenate(FragmentA=panel_9)
send = GhPythonScript(
    robot=tool_2,
    approach_pickup_config=robota_pick_approach_config,
    approach_place_plane=approach_placing_plane_robota,
    pickup_plane=robota_pickup_plane,
    approach_place_config=robota_approach_place_config,
    place_plane=robota_place_plane,
    configurations_pick_to_place=trajectory_visualize.configurations,
    export=export,
    speed=Slider(83, range=0..83),
    file_name="robotA_place_00",
    selected_robot=concatenate)  # -> actions; inputs approach_place_plane: Plane, pickup_plane: Plane, configurations_pick_to_place: list
# ---------- send: Python ----------
from datetime import datetime as dt
import os
import compas
import sys
from compas_rhino import unload_modules
from compas_rhino.conversions import RhinoPlane, RhinoMesh
from compas.geometry import Scale, Frame
from compas_fab.robots import Robot
from compas_ghpython.utilities import ghtree_to_list
import compas_rrc as rrc
import time
from compas_rhino.conversions import plane_to_compas_frame
import Rhino.Geometry as rg
import math


#set the folder path
HERE = ghenv.LocalScope.ghdoc.Path
DATA = os.path.abspath(os.path.join(HERE, '..', '..', 'data'))
now = dt.now().strftime("%Y%m%d_")
file_path = DATA + "/" + now + file_name + ".json"

path = DATA = os.path.abspath(os.path.join(HERE, '..', '..', 'process'))
if path not in sys.path:
    sys.path.append(path)

#set the scaling factor from meters to mm
scalefactor = 1000
S = Scale.from_factors([scalefactor] * 3)

unload_modules('production_data')
from production_data import Action, ProductionData

#initialize actions
actions = []


# Set the tool
actions.append(Action('SetTool', dict(tool_name='tool0'), action_id = 0))  #here we set the tcp to the flange of the robot
# Set work object
actions.append(Action('SetWorkObject', dict(wobj_name='wobj0'), action_id = 1))
id = 1

#print text on the teach pendant and wait for action
id +=1
actions.append(Action('PrintText', dict(text='Pickup Element?'), action_id = id))
id +=1
actions.append(Action('Stop', dict(), action_id = id))

#open gripper
id +=1
actions.append(Action('SetDigital', dict(io_name = 'XS14_1', value = 0),action_id = id))

#send above pickup position with configuration
joints = [math.degrees(j) for j in approach_pickup_config.joint_values]
id +=1
actions.append(Action('MoveToJoints', dict(joints = joints, ext_axes = [], speed=speed, zone= rrc.Zone.FINE, feedback_level=rrc.FeedbackLevel.DONE), action_id = id))

#send to pickup with linear movement (plane)
frame = plane_to_compas_frame(pickup_plane)
print(frame)
frame_rob = robot.from_tcf_to_t0cf([frame])[0]  #transform from Tcf to T0cf as we have not declared any tool
scaled_frame = frame_rob.transformed(S) #convert to mm again
print(scaled_frame) 
id +=1
actions.append(Action('MoveToFrame', dict(frame= scaled_frame, speed=speed, zone=rrc.Zone.FINE, motion_type='rrc.Motion.LINEAR',feedback_level=rrc.FeedbackLevel.DONE), action_id = id))

#wait
id +=1
actions.append(Action('WaitTime', dict(time = 1,  feedback_level=rrc.FeedbackLevel.DONE), action_id = id))

#close
id +=1
actions.append(Action('SetDigital', dict(io_name = 'XS14_1', value = 1),action_id = id))

#print text on the teach pendant and wait for action
id +=1
actions.append(Action('PrintText', dict(text='Move Element to position?'), action_id = id))
id +=1
actions.append(Action('Stop', dict(), action_id = id))

#wait

id +=1
actions.append(Action('WaitTime', dict(time = 1,  feedback_level=rrc.FeedbackLevel.DONE), action_id = id))


#config
#send above pickup with configuration
joints = [math.degrees(j) for j in approach_pickup_config.joint_values]
id +=1
actions.append(Action('MoveToJoints', dict(joints = joints, ext_axes = [], speed=speed, zone= rrc.Zone.FINE, feedback_level=rrc.FeedbackLevel.DONE), action_id = id))

#trajectory from approach pickup to approach place
for configuration in configurations_pick_to_place:
    temp = []
    print(configuration)
    for n,j in zip(configuration.joint_names,configuration.joint_values):
        if n == str(selected_robot)+"_joint_1":
            temp.append(j)
    for n,j in zip(configuration.joint_names,configuration.joint_values):
        if n == str(selected_robot)+"_joint_2":
            temp.append(j)
    for n,j in zip(configuration.joint_names,configuration.joint_values):
        if n == str(selected_robot)+"_joint_3":
            temp.append(j)
    for n,j in zip(configuration.joint_names,configuration.joint_values):
        if n == str(selected_robot)+"_joint_4":
            temp.append(j)
    for n,j in zip(configuration.joint_names,configuration.joint_values):
        if n == str(selected_robot)+"_joint_5":
            temp.append(j)
    for n,j in zip(configuration.joint_names,configuration.joint_values):
        if n == str(selected_robot)+"_joint_6":
            temp.append(j)

    joints = [math.degrees(j) for j in temp]
    print joints
    id +=1
    actions.append(Action('MoveToJoints', dict(joints = joints, ext_axes = [], speed=speed, zone= 5, feedback_level=rrc.FeedbackLevel.DONE), action_id = id))

#print text on the teach pendant and wait for action
id +=1
actions.append(Action('PrintText', dict(text='should the Robot place the element at the final position?'), action_id = id))
id +=1
actions.append(Action('Stop', dict(), action_id = id))

#place with plane
frame = plane_to_compas_frame(place_plane)
frame_rob = robot.from_tcf_to_t0cf([frame])[0]
scaled_frame = frame_rob.transformed(S)
id +=1
actions.append(Action('MoveToFrame', dict(frame= scaled_frame, speed=speed, zone=rrc.Zone.FINE, motion_type='rrc.Motion.LINEAR',feedback_level=rrc.FeedbackLevel.DONE), action_id = id))

#can I leave?
id +=1
actions.append(Action('PrintText', dict(text='Release element?'), action_id = id))
id +=1
actions.append(Action('Stop', dict(), action_id = id))

#open gripper
id +=1
actions.append(Action('SetDigital', dict(io_name = 'XS14_1', value = 0),action_id = id))

#wait
id +=1
actions.append(Action('WaitTime', dict(time = 0.5,  feedback_level=rrc.FeedbackLevel.DONE), action_id = id))

#send to approach place plane
frame = plane_to_compas_frame(approach_place_plane)
frame_rob = robot.from_tcf_to_t0cf([frame])[0]
scaled_frame = frame_rob.transformed(S)
id +=1
actions.append(Action('MoveToFrame', dict(frame= scaled_frame, speed=speed, zone=rrc.Zone.FINE, motion_type='rrc.Motion.LINEAR',feedback_level=rrc.FeedbackLevel.DONE), action_id = id))

#send above pickup with configuration
id +=1
actions.append(Action('PrintText', dict(text='Send Robot to pick up station?'), action_id = id))
id +=1
actions.append(Action('Stop', dict(), action_id = id))

#REVERSE?
for configuration in configurations_pick_to_place[::-1]:
    temp = []
    for n,j in zip(configuration.joint_names,configuration.joint_values):
        if n == str(selected_robot)+"_joint_1":
            temp.append(j)
    for n,j in zip(configuration.joint_names,configuration.joint_values):
        if n == str(selected_robot)+"_joint_2":
            temp.append(j)
    for n,j in zip(configuration.joint_names,configuration.joint_values):
        if n == str(selected_robot)+"_joint_3":
            temp.append(j)
    for n,j in zip(configuration.joint_names,configuration.joint_values):
        if n == str(selected_robot)+"_joint_4":
            temp.append(j)
    for n,j in zip(configuration.joint_names,configuration.joint_values):
        if n == str(selected_robot)+"_joint_5":
            temp.append(j)
    for n,j in zip(configuration.joint_names,configuration.joint_values):
        if n == str(selected_robot)+"_joint_6":
            temp.append(j)

    joints = [math.degrees(j) for j in temp]
    #print joints
    id +=1
    actions.append(Action('MoveToJoints', dict(joints = joints, ext_axes = [], speed=speed, zone= 5, feedback_level=rrc.FeedbackLevel.DONE), action_id = id))


production_data = ProductionData(actions)

if export:
    with open(file_path, 'w') as fp:
        compas.json_dump(production_data.to_data(), fp)
# ---------- end send ----------

# ----
# PICK ROBOT B
orient_5 = Orient(Geometry=center_box, Source=PlaneXY(0, 0, 0), Target=flip_plane_2.Flipped)  # -> Geometry, Transform

# ----
# approach pick config
inverse_kinematics_6 = InverseKinematics(robot=tool, plane=move_4.Geometry, group="robot_B")  # -> configuration; same code as inverse_kinematics
merge_config_2 = MergeConfig(config_a=zero_config, config_b=inverse_kinematics_6)  # -> config; same code as merge_config

# ----
# approach place config
inverse_kinematics_7 = InverseKinematics(robot=tool, plane=move_6.Geometry, start_configuration=merge_config_2, group="robot_B")  # -> configuration; same code as inverse_kinematics

# ----
# pick config
inverse_kinematics_8 = InverseKinematics(robot=tool, plane=flip_plane_2.Flipped, start_configuration=merge_config_2, group="robot_B")  # -> configuration; same code as inverse_kinematics

panel_10 = Panel(inverse_kinematics_8)
robot_visualize_4 = RobotVisualize(robot=tool, group="robot_B", configuration=inverse_kinematics_6)  # -> visual, collision, collision_meshes, attached_meshes, frames, base_frame, ee_frame; inputs show_visual: Boolean, show_collision: Boolean, show_frames: Boolean, show_base_frame: Boolean, show_end_effector_frame: Boolean, show_cm: Boolean, show_acm: Boolean; same code as robot_visualize

constraints_from_target_configuration_2 = ConstraintsFromTargetConfiguration(robot=tool, target_configuration=inverse_kinematics_7, group="robot_B")  # -> constraints; same code as constraints_from_target_configuration
plan_motion_2 = PlanMotion(
    robot=tool,
    goal_constraints=constraints_from_target_configuration_2,
    start_configuration=merge_config_2,
    group="robot_B",
    attached_collision_meshes=attached_collision_mesh_2,
    compute=Toggle(True))  # -> trajectory; inputs goal_constraints: list, attached_collision_meshes: list, path_constraints: list, compute: Boolean; same code as plan_motion
trajectory_visualize_2 = TrajectoryVisualize(robot=tool, group="robot_B", trajectory=plan_motion_2)  # -> start_configuration, configurations, fraction, time, planes, P, V, A; same code as trajectory_visualize

# ----
# EXPORT
panel_11 = Panel("robotB")
pick_approach_config = Data(inverse_kinematics_6)
approach_place_plane = Plane(move_6.Geometry)
approach_place_config = Data(inverse_kinematics_7)
export_2 = Button()
pickup_plane = Plane(flip_plane_2.Flipped)
place_plane = Plane(flip_plane_4.Flipped)
concatenate_2 = Concatenate(FragmentA=panel_11)
send_2 = GhPythonScript(
    robot=tool,
    approach_pickup_config=pick_approach_config,
    approach_place_plane=approach_place_plane,
    pickup_plane=pickup_plane,
    approach_place_config=approach_place_config,
    place_plane=place_plane,
    configurations_pick_to_place=trajectory_visualize_2.configurations,
    export=export_2,
    speed=Slider(83, range=0..83),
    file_name="robotB_place_00",
    selected_robot=concatenate_2)  # -> actions; inputs approach_place_plane: Plane, pickup_plane: Plane, configurations_pick_to_place: list
# ---------- send_2: Python ----------
from datetime import datetime as dt
import os
import compas
import sys
from compas_rhino import unload_modules
from compas_rhino.conversions import RhinoPlane, RhinoMesh
from compas.geometry import Scale, Frame
from compas_fab.robots import Robot
from compas_ghpython.utilities import ghtree_to_list
import compas_rrc as rrc
import time
from compas_rhino.conversions import plane_to_compas_frame
import Rhino.Geometry as rg
import math


#set the folder path
HERE = ghenv.LocalScope.ghdoc.Path
DATA = os.path.abspath(os.path.join(HERE, '..', '..', 'data'))
now = dt.now().strftime("%Y%m%d_")
file_path = DATA + "/" + now + file_name + ".json"

path = DATA = os.path.abspath(os.path.join(HERE, '..', '..', 'process'))
if path not in sys.path:
    sys.path.append(path)

#set the scaling factor from meters to mm
scalefactor = 1000
S = Scale.from_factors([scalefactor] * 3)

unload_modules('production_data')
from production_data import Action, ProductionData

#initialize actions
actions = []


# Set the tool
actions.append(Action('SetTool', dict(tool_name='tool0'), action_id = 0))  #here we set the tcp to the flange of the robot
# Set work object
actions.append(Action('SetWorkObject', dict(wobj_name='wobj0'), action_id = 1))
id = 1

#print text on the teach pendant and wait for action
id +=1
actions.append(Action('PrintText', dict(text='Pickup Element?'), action_id = id))
id +=1
actions.append(Action('Stop', dict(), action_id = id))

#open gripper
id +=1
actions.append(Action('SetDigital', dict(io_name = 'DO_01', value = 0),action_id = id))

#send above pickup position with configuration
joints = [math.degrees(j) for j in approach_pickup_config.joint_values]
id +=1
actions.append(Action('MoveToJoints', dict(joints = joints, ext_axes = [], speed=speed, zone= rrc.Zone.FINE, feedback_level=rrc.FeedbackLevel.DONE), action_id = id))

#send to pickup with linear movement (plane)
frame = plane_to_compas_frame(pickup_plane)
print(frame)
frame_rob = robot.from_tcf_to_t0cf([frame])[0]  #transform from Tcf to T0cf as we have not declared any tool
scaled_frame = frame_rob.transformed(S) #convert to mm again
print(scaled_frame) 
id +=1
actions.append(Action('MoveToFrame', dict(frame= scaled_frame, speed=speed, zone=rrc.Zone.FINE, motion_type='rrc.Motion.LINEAR',feedback_level=rrc.FeedbackLevel.DONE), action_id = id))

#wait
id +=1
actions.append(Action('WaitTime', dict(time = 1,  feedback_level=rrc.FeedbackLevel.DONE), action_id = id))

#close
id +=1
actions.append(Action('SetDigital', dict(io_name = 'DO_01', value = 1),action_id = id))

#print text on the teach pendant and wait for action
id +=1
actions.append(Action('PrintText', dict(text='Move Element to position?'), action_id = id))
id +=1
actions.append(Action('Stop', dict(), action_id = id))

#wait

id +=1
actions.append(Action('WaitTime', dict(time = 1,  feedback_level=rrc.FeedbackLevel.DONE), action_id = id))


#config
#send above pickup with configuration
joints = [math.degrees(j) for j in approach_pickup_config.joint_values]
id +=1
actions.append(Action('MoveToJoints', dict(joints = joints, ext_axes = [], speed=speed, zone= rrc.Zone.FINE, feedback_level=rrc.FeedbackLevel.DONE), action_id = id))

#trajectory from approach pickup to approach place
for configuration in configurations_pick_to_place:
    temp = []
    print(configuration)
    for n,j in zip(configuration.joint_names,configuration.joint_values):
        if n == str(selected_robot)+"_joint_1":
            temp.append(j)
    for n,j in zip(configuration.joint_names,configuration.joint_values):
        if n == str(selected_robot)+"_joint_2":
            temp.append(j)
    for n,j in zip(configuration.joint_names,configuration.joint_values):
        if n == str(selected_robot)+"_joint_3":
            temp.append(j)
    for n,j in zip(configuration.joint_names,configuration.joint_values):
        if n == str(selected_robot)+"_joint_4":
            temp.append(j)
    for n,j in zip(configuration.joint_names,configuration.joint_values):
        if n == str(selected_robot)+"_joint_5":
            temp.append(j)
    for n,j in zip(configuration.joint_names,configuration.joint_values):
        if n == str(selected_robot)+"_joint_6":
            temp.append(j)

    joints = [math.degrees(j) for j in temp]
    print joints
    id +=1
    actions.append(Action('MoveToJoints', dict(joints = joints, ext_axes = [], speed=speed, zone= 5, feedback_level=rrc.FeedbackLevel.DONE), action_id = id))

#print text on the teach pendant and wait for action
id +=1
actions.append(Action('PrintText', dict(text='should the Robot place the element at the final position?'), action_id = id))
id +=1
actions.append(Action('Stop', dict(), action_id = id))

#place with plane
frame = plane_to_compas_frame(place_plane)
frame_rob = robot.from_tcf_to_t0cf([frame])[0]
scaled_frame = frame_rob.transformed(S)
id +=1
actions.append(Action('MoveToFrame', dict(frame= scaled_frame, speed=speed, zone=rrc.Zone.FINE, motion_type='rrc.Motion.LINEAR',feedback_level=rrc.FeedbackLevel.DONE), action_id = id))

#can I leave?
id +=1
actions.append(Action('PrintText', dict(text='Release element?'), action_id = id))
id +=1
actions.append(Action('Stop', dict(), action_id = id))

#open gripper
id +=1
actions.append(Action('SetDigital', dict(io_name = 'DO_01', value = 0),action_id = id))

#wait
id +=1
actions.append(Action('WaitTime', dict(time = 0.5,  feedback_level=rrc.FeedbackLevel.DONE), action_id = id))

#send to approach place plane
frame = plane_to_compas_frame(approach_place_plane)
frame_rob = robot.from_tcf_to_t0cf([frame])[0]
scaled_frame = frame_rob.transformed(S)
id +=1
actions.append(Action('MoveToFrame', dict(frame= scaled_frame, speed=speed, zone=rrc.Zone.FINE, motion_type='rrc.Motion.LINEAR',feedback_level=rrc.FeedbackLevel.DONE), action_id = id))

#send above pickup with configuration
id +=1
actions.append(Action('PrintText', dict(text='Send Robot to pick up station?'), action_id = id))
id +=1
actions.append(Action('Stop', dict(), action_id = id))

#REVERSE?
for configuration in configurations_pick_to_place[::-1]:
    temp = []
    for n,j in zip(configuration.joint_names,configuration.joint_values):
        if n == str(selected_robot)+"_joint_1":
            temp.append(j)
    for n,j in zip(configuration.joint_names,configuration.joint_values):
        if n == str(selected_robot)+"_joint_2":
            temp.append(j)
    for n,j in zip(configuration.joint_names,configuration.joint_values):
        if n == str(selected_robot)+"_joint_3":
            temp.append(j)
    for n,j in zip(configuration.joint_names,configuration.joint_values):
        if n == str(selected_robot)+"_joint_4":
            temp.append(j)
    for n,j in zip(configuration.joint_names,configuration.joint_values):
        if n == str(selected_robot)+"_joint_5":
            temp.append(j)
    for n,j in zip(configuration.joint_names,configuration.joint_values):
        if n == str(selected_robot)+"_joint_6":
            temp.append(j)

    joints = [math.degrees(j) for j in temp]
    #print joints
    id +=1
    actions.append(Action('MoveToJoints', dict(joints = joints, ext_axes = [], speed=speed, zone= 5, feedback_level=rrc.FeedbackLevel.DONE), action_id = id))


production_data = ProductionData(actions)

if export:
    with open(file_path, 'w') as fp:
        compas.json_dump(production_data.to_data(), fp)
# ---------- end send_2 ----------

list_item_3 = ListItem(List=trajectory_visualize_2.configurations, Index=0, Wrap=True)
run_2 = BooleanToggle(True)

# ----
# MOTION PLANNING B
# attached element
panel_12 = Panel("robot_B")

ghpython_script_2 = GhPythonScript(robot=tool, conf=list_item_3, group=panel_12)  # -> out, a; same code as ghpython_script
merge_2 = Merge(Data1=flatten(trajectory_visualize_2.configurations), Data2=flatten(ghpython_script_2.a))
list_length_2 = ListLength(List=merge_2)
python_2 = PythonScript(Run=run_2, Target=list_length_2, Interval=Slider(25, range=1..1000))  # -> Counter; inputs Run: Boolean; same code as python
item_2 = ListItem(List=merge_2, Index=python_2, Wrap=True)
panel_13 = Panel(python_2)
robot_visualize_5 = RobotVisualize(
    robot=tool,
    acm=move_9.Geometry,
    group="robot_B",
    configuration=item_2,
    show_frames=Toggle(False),
    show_end_effector_frame=Toggle(True),
    show_cm=Toggle(True),
    show_acm=Toggle(True),
    t0cf_2_tcp=number_slider_9)  # -> visual, collision, collision_meshes, attached_meshes, frames, base_frame, ee_frame; inputs acm: Mesh, show_visual: Boolean, show_collision: Boolean, show_frames: Boolean, show_base_frame: Boolean, show_end_effector_frame: Boolean, show_cm: Boolean, show_acm: Boolean; same code as robot_visualize_3
mesh_2 = Mesh(robot_visualize_5.attached_meshes)

geometry_3 = Geometry(robot_visualize_5.ee_frame)
