# Grasshopper definition planning02_spatial_template.gh (Grasshopper 1.0.7)
# plug-ins: Pufferfish

geometry = Geometry([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])
volume = Volume(Geometry=geometry)  # -> Volume, Centroid
# PICKUP POSITION
number_slider = Slider(-0.075, range=-0.9..1)
# ELEMENTS
point_list = PointList(Points=volume.Centroid, Size=Slider(0.02, range=0..10))
unit_z = UnitZ(Factor=number_slider)
geometry_2 = Geometry(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)
point = Point(Point(0.3256446368, 0.2591018316, 0.04172218246))
mesh_brep = MeshBrep(
    Brep=geometry_2,
    Settings={GridMaxCount=0, GridMinCount=16, JaggedSeams=False, MaxEdgeLength=0, MinEdgeLength=0.0001, MinTolerance=0, Refine=True, RefineAngle=0, RelativeTolerance=0.65, SimplePlanes=True, Tolerance=0})
move = Move(Geometry=point, Motion=unit_z)  # -> Geometry, Transform
# TRANSFORM A<->B
transformation_from_a_to_b = GhPythonScript()  # -> a_2_b, b_2_a
# ---------- transformation_from_a_to_b: Python ----------
import Rhino.Geometry as rg
import math

# Transformation matrix inputs
x = 0.5347479398223676
y = -0.7939334915306736
z = 0.0007630697140932686
r = 0.00801613165265005  # Roll
p = -0.0064154595608891625 # Pitch
yaw = 3.133456800610911  # Yaw

# Compute rotation matrix
cos_r, sin_r = math.cos(r), math.sin(r)
cos_p, sin_p = math.cos(p), math.sin(p)
cos_y, sin_y = math.cos(yaw), math.sin(yaw)

# Rotation matrix components
m00 = cos_y * cos_p
m01 = cos_y * sin_p * sin_r - sin_y * cos_r
m02 = cos_y * sin_p * cos_r + sin_y * sin_r
m10 = sin_y * cos_p
m11 = sin_y * sin_p * sin_r + cos_y * cos_r
m12 = sin_y * sin_p * cos_r - cos_y * sin_r
m20 = -sin_p
m21 = cos_p * sin_r
m22 = cos_p * cos_r

# Create Rhino Transform object
rotation_matrix = rg.Transform.Identity
rotation_matrix.M00 = m00
rotation_matrix.M01 = m01
rotation_matrix.M02 = m02
rotation_matrix.M10 = m10
rotation_matrix.M11 = m11
rotation_matrix.M12 = m12
rotation_matrix.M20 = m20
rotation_matrix.M21 = m21
rotation_matrix.M22 = m22

# Add translation
rotation_matrix.M03 = x
rotation_matrix.M13 = y
rotation_matrix.M23 = z


# Compute inverse
success, inverse_matrix = rg.Transform.TryGetInverse(rotation_matrix)

# Output
a_2_b = rotation_matrix
b_2_a = inverse_matrix if success else None  # Return None if inversion fails
# ---------- end transformation_from_a_to_b ----------
# ROBOT
transform = Transform(Geometry=move.Geometry, Transform=transformation_from_a_to_b.a_2_b)
pick_point_b = Point(transform)
transform_2 = Transform(Geometry=move.Geometry, Transform=transformation_from_a_to_b.a_2_b)
point_2 = Point(transform_2)
number_slider_2 = Slider(1, range=0..100)
number_slider_3 = Slider(1, range=0..100)
info = Info()  # -> info
#   port info: Environment info.
# ---------- info: Python ----------
"""
Displays information about the active COMPAS environment.
"""
import compas_bootstrapper
from ghpythonlib.componentbase import executingcomponent as component

import compas
import compas_fab


class CompasInfo(component):
    def RunScript(self):
        self.Message = 'COMPAS v{}'.format(compas.__version__)
        info = 'COMPAS Version: {}\nEnvironment: {}\nCOMPAS FAB Version:{}'
        return (info.format(compas.__version__, compas_bootstrapper.ENVIRONMENT_NAME,compas_fab.__version__))
# ---------- end info ----------

# ----
# Load Robot
connect = BooleanToggle(True)
ros_connect = ROSConnect(connect=connect)  # -> ros_client, is_connected; inputs port: Int32, connect: Boolean
#   port ip: The ip address ROS. Defaults to 127.0.0.1.
#   port port: The port of ROS. Defaults to 9090.
#   port connect: If True, connects to ROS. If False, disconnects from ROS. Defaults to False.
#   port ros_client: The ROS client.
#   port is_connected: True if connection established.
# ---------- ros_connect: Python ----------
"""
Connect or disconnect to ROS.

COMPAS FAB v0.27.0
"""
from ghpythonlib.componentbase import executingcomponent as component
from scriptcontext import sticky as st

from compas_fab.backends import RosClient
from compas_fab.ghpython.components import create_id


class ROSConnect(component):
    def RunScript(self, ip, port, connect):
        ros_client = None

        ip = ip or '127.0.0.1'
        port = port or 9090

        key = create_id(self, 'ros_client')
        ros_client = st.get(key, None)

        if ros_client:
            st[key].close()
        if connect:
            st[key] = RosClient(ip, port)
            st[key].run(5)

        ros_client = st.get(key, None)
        is_connected = ros_client.is_connected if ros_client else False
        return (ros_client, is_connected)
# ---------- end ros_connect ----------
load_robot = BooleanToggle(True)
ros_robot = ROSRobot(ros_client=ros_connect.ros_client, load=load_robot)  # -> robot; inputs load: Boolean
#   port ros_client: The ROS client.
#   port load: If True, loads the robot from ROS. Defaults to False.
# ---------- ros_robot: Python ----------
"""
Load robot directly from ROS.

COMPAS FAB v0.27.0
"""
from compas_ghpython.artists import RobotModelArtist
from ghpythonlib.componentbase import executingcomponent as component
from scriptcontext import sticky as st

from compas_fab.ghpython.components import create_id


class ROSRobot(component):
    def RunScript(self, ros_client, load):
        key = create_id(self, 'robot')

        if ros_client and ros_client.is_connected and load:
            # Load URDF from ROS
            st[key] = ros_client.load_robot(load_geometry=True, precision='12f')
            st[key].artist = RobotModelArtist(st[key].model)

        robot = st.get(key, None)
        if robot:  # client sometimes need to be restarted, without needing to reload geometry
            robot.client = ros_client
        return robot
# ---------- end ros_robot ----------

# ----
# SCENE
planning_scene = PlanningScene(robot=ros_robot)  # -> scene
#   port scene: A planning scene.
# ---------- planning_scene: Python ----------
"""
Create a planning scene.

COMPAS FAB v0.27.0
"""
from ghpythonlib.componentbase import executingcomponent as component
from scriptcontext import sticky as st

from compas_fab.ghpython.components import create_id
from compas_fab.robots import PlanningScene


class PlanningSceneComponent(component):
    def RunScript(self, robot):
        key = create_id(self, 'planning_scene')
        if robot:
            st[key] = PlanningScene(robot)
        return st.get(key, None)
# ---------- end planning_scene ----------

# ----
# ZERO Configs
panel = Panel("robot_A")
zero_config = ZeroConfig(robot=ros_robot, group=panel)  # -> config
#   port group: If assigned, it will return the zero configuration for the given group, otherwise a full zero configuration.
#   port config: The zero configuration.
# ---------- zero_config: Python ----------
"""
Get a zero configuration for a robot.

COMPAS FAB v0.27.0
"""
from ghpythonlib.componentbase import executingcomponent as component


class ConfigZero(component):
    def RunScript(self, robot, group):

        if robot:
            return robot.zero_configuration(group)

        return None
# ---------- end zero_config ----------
zero_config_2 = ZeroConfig(robot=ros_robot)  # -> config; same code as zero_config
zero_config_3 = ZeroConfig(robot=ros_robot, group="robot_B")  # -> config; same code as zero_config

collision_mesh = CollisionMesh(
    scene=planning_scene,
    mesh=mesh_brep,
    identifier="robot_table",
    add=Toggle(True),
    append=Toggle(False),
    remove=Toggle(False))  # -> ok; inputs mesh: Mesh, add: Boolean, append: Boolean, remove: Boolean
#   port scene: The planning scene.
#   port mesh: A collision mesh.
#   port identifier: The identifier of the collision mesh.
#   port add: If True, adds the collision mesh to the planning scene.
#   port append: If True, appends the collision mesh to the planning scene.
#   port remove: If True, removes the collision mesh from the planning scene.
#   port ok: True if the operation was successfully performed.
# ---------- collision_mesh: Python ----------
"""
Add or remove a collision mesh from the planning scene.

COMPAS FAB v0.27.0
"""
from compas_rhino.geometry import RhinoMesh
from ghpythonlib.componentbase import executingcomponent as component

from compas_fab.robots import CollisionMesh


class CollisionMeshComponent(component):
    def RunScript(self, scene, M, name, add, append, remove):
        ok = False
        self.Message = ""

        if (add and append) or (append and remove) or (add and remove):
            self.Message = "Use only one operation at a time\n(add, append or remove)"
            raise Exception(self.Message)

        if scene and M and name:
            mesh = RhinoMesh.from_geometry(M).to_compas()
            collision_mesh = CollisionMesh(mesh, name)
            if add:
                scene.add_collision_mesh(collision_mesh)
                self.Message = "Added"
                ok = True
            if append:
                scene.append_collision_mesh(collision_mesh)
                self.Message = "Appended"
                ok = True
            if remove:
                scene.remove_collision_mesh(name)
                self.Message = "Removed"
                ok = True
        return ok
# ---------- end collision_mesh ----------
# Package Version: COMPAS Version: 1.17.10
# Environment: design6197
# COMPAS FAB Version:0.27.0
your_version = Panel(info)
number_slider_4 = Slider(45, range=-360..360)
gripper_lowpoly = Mesh(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)
rotate = Rotate(Geometry=gripper_lowpoly, Angle=degrees(number_slider_4), Plane=PlaneXY(0, 0, 0))  # -> Geometry, Transform

# ----
# Labeled Robots
labels = Geometry([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])

zero_config_4 = ZeroConfig(robot=ros_robot)  # -> config; same code as zero_config
panel_2 = Panel(zero_config_4)
xy_plane = XYPlane(Origin=Point(0, 0, 0))
xy_plane_2 = XYPlane(Origin=Point(0, 0, 0))

# ----
# PICK ROBOT A
# pick plane
xy_plane_3 = XYPlane(Origin=move.Geometry)
flip_plane = FlipPlane(Plane=xy_plane_3, FlipX=False, FlipY=False, FlipZ=True)  # -> Flipped, ResultBoolean

# ----
# approach place plane
boolean_toggle = BooleanToggle(False)

# ----
# approach pick plane
number_slider_5 = Slider(0.08, range=0..1)
unit_z_2 = UnitZ(Factor=number_slider_5)
# pick config
# approach pick config
# place config
move_2 = Move(Geometry=flip_plane.Flipped, Motion=unit_z_2)  # -> Geometry, Transform

# ----
# PICK ROBOT B
# pick plane
xy_plane_4 = XYPlane(Origin=pick_point_b)
flip_plane_2 = FlipPlane(Plane=xy_plane_4, FlipX=False, FlipY=False, FlipZ=True)  # -> Flipped, ResultBoolean

# ----
# approach pick plane
# PLACE ROBOT B
number_slider_6 = Slider(0.08, range=0..1)
unit_z_3 = UnitZ(Factor=number_slider_6)
# pick config
# approach pick config
# place config
move_3 = Move(Geometry=flip_plane_2.Flipped, Motion=unit_z_3)  # -> Geometry, Transform

# ----
# MOTION PLANNING A
# trajectory
panel_3 = Panel("acm_robA")
panel_4 = Panel("robotA_tool0")
panel_5 = Panel("""robotA_tool0
robotA_link_6""")
toggle = BooleanToggle(False)
# attached element
button = Button()

panel_6 = Panel("acm_robB")
panel_7 = Panel("robotB_tool0")
panel_8 = Panel("""robotB_tool0
robotB_link_6""")
toggle_2 = BooleanToggle(False)
button_2 = Button()

# ----
# EXPORT
panel_9 = Panel("robotB")
approach_place_plane = Plane(Plane(origin=(0.3943346491, 0.04049411799, 0.3676446038), x=(-0.024578009, -0.0007541304728, 0.9996976307), y=(0.3137178998, -0.9494904562, 0.006996637247)))
approach_place_config = Data()
pick_approach_config = Data()
export = Button()
pickup_plane = Plane()
place_plane = Plane()
concatenate = Concatenate(FragmentA=panel_9)
send = GhPythonScript(
    approach_pickup_config=pick_approach_config,
    approach_place_plane=approach_place_plane,
    pickup_plane=pickup_plane,
    approach_place_config=approach_place_config,
    place_plane=place_plane,
    export=export,
    speed=Slider(83, range=0..83),
    file_name="robotB_place_stick00",
    selected_robot=concatenate)  # -> actions; inputs approach_place_plane: Plane, pickup_plane: Plane, configurations_pick_to_place: list
# ---------- send: Python ----------
from datetime import datetime as dt
import os
import compas
import sys
from compas_rhino import unload_modules
from compas_rhino.conversions import RhinoPlane, RhinoMesh
from compas.geometry import Scale, Frame
from compas_fab.robots import Robot
from compas_ghpython.utilities import ghtree_to_list
import compas_rrc as rrc
import time
from compas_rhino.conversions import plane_to_compas_frame
import Rhino.Geometry as rg
import math


#set the folder path
HERE = ghenv.LocalScope.ghdoc.Path
DATA = os.path.abspath(os.path.join(HERE, '..', '..', 'data'))
now = dt.now().strftime("%Y%m%d_")
file_path = DATA + "/" + now + file_name + ".json"

path = DATA = os.path.abspath(os.path.join(HERE, '..', '..', 'process'))
if path not in sys.path:
    sys.path.append(path)

#set the scaling factor from meters to mm
scalefactor = 1000
S = Scale.from_factors([scalefactor] * 3)

unload_modules('production_data')
from production_data import Action, ProductionData

#initialize actions
actions = []


# Set the tool
actions.append(Action('SetTool', dict(tool_name='tool0'), action_id = 0))  #here we set the tcp to the flange of the robot
# Set work object
actions.append(Action('SetWorkObject', dict(wobj_name='wobj0'), action_id = 1))
id = 1

#print text on the teach pendant and wait for action
id +=1
actions.append(Action('PrintText', dict(text='Pickup Element?'), action_id = id))
id +=1
actions.append(Action('Stop', dict(), action_id = id))

#open gripper
id +=1
actions.append(Action('SetDigital', dict(io_name = 'XS14_1', value = 0),action_id = id))

#send above pickup position with configuration
joints = [math.degrees(j) for j in approach_pickup_config.joint_values]
id +=1
actions.append(Action('MoveToJoints', dict(joints = joints, ext_axes = [], speed=speed, zone= rrc.Zone.FINE, feedback_level=rrc.FeedbackLevel.DONE), action_id = id))

#send to pickup with linear movement (plane)
frame = plane_to_compas_frame(pickup_plane)
print(frame)
frame_rob = robot.from_tcf_to_t0cf([frame])[0]  #transform from Tcf to T0cf as we have not declared any tool
scaled_frame = frame_rob.transformed(S) #convert to mm again
print(scaled_frame) 
id +=1
actions.append(Action('MoveToFrame', dict(frame= scaled_frame, speed=speed, zone=rrc.Zone.FINE, motion_type='rrc.Motion.LINEAR',feedback_level=rrc.FeedbackLevel.DONE), action_id = id))

#wait
id +=1
actions.append(Action('WaitTime', dict(time = 1,  feedback_level=rrc.FeedbackLevel.DONE), action_id = id))

#close
id +=1
actions.append(Action('SetDigital', dict(io_name = 'XS14_1', value = 1),action_id = id))

#print text on the teach pendant and wait for action
id +=1
actions.append(Action('PrintText', dict(text='Move Element to position?'), action_id = id))
id +=1
actions.append(Action('Stop', dict(), action_id = id))

#wait

id +=1
actions.append(Action('WaitTime', dict(time = 1,  feedback_level=rrc.FeedbackLevel.DONE), action_id = id))


#config
#send above pickup with configuration
joints = [math.degrees(j) for j in approach_pickup_config.joint_values]
id +=1
actions.append(Action('MoveToJoints', dict(joints = joints, ext_axes = [], speed=speed, zone= rrc.Zone.FINE, feedback_level=rrc.FeedbackLevel.DONE), action_id = id))

#trajectory from approach pickup to approach place
for configuration in configurations_pick_to_place:
    temp = []
    print(configuration)
    for n,j in zip(configuration.joint_names,configuration.joint_values):
        if n == str(selected_robot)+"_joint_1":
            temp.append(j)
    for n,j in zip(configuration.joint_names,configuration.joint_values):
        if n == str(selected_robot)+"_joint_2":
            temp.append(j)
    for n,j in zip(configuration.joint_names,configuration.joint_values):
        if n == str(selected_robot)+"_joint_3":
            temp.append(j)
    for n,j in zip(configuration.joint_names,configuration.joint_values):
        if n == str(selected_robot)+"_joint_4":
            temp.append(j)
    for n,j in zip(configuration.joint_names,configuration.joint_values):
        if n == str(selected_robot)+"_joint_5":
            temp.append(j)
    for n,j in zip(configuration.joint_names,configuration.joint_values):
        if n == str(selected_robot)+"_joint_6":
            temp.append(j)

    joints = [math.degrees(j) for j in temp]
    print joints
    id +=1
    actions.append(Action('MoveToJoints', dict(joints = joints, ext_axes = [], speed=speed, zone= 5, feedback_level=rrc.FeedbackLevel.DONE), action_id = id))

#print text on the teach pendant and wait for action
id +=1
actions.append(Action('PrintText', dict(text='should the Robot place the element at the final position?'), action_id = id))
id +=1
actions.append(Action('Stop', dict(), action_id = id))

#place with plane
frame = plane_to_compas_frame(place_plane)
frame_rob = robot.from_tcf_to_t0cf([frame])[0]
scaled_frame = frame_rob.transformed(S)
id +=1
actions.append(Action('MoveToFrame', dict(frame= scaled_frame, speed=speed, zone=rrc.Zone.FINE, motion_type='rrc.Motion.LINEAR',feedback_level=rrc.FeedbackLevel.DONE), action_id = id))

#can I leave?
id +=1
actions.append(Action('PrintText', dict(text='Release element?'), action_id = id))
id +=1
actions.append(Action('Stop', dict(), action_id = id))

#open gripper
id +=1
actions.append(Action('SetDigital', dict(io_name = 'XS14_1', value = 0),action_id = id))

#wait
id +=1
actions.append(Action('WaitTime', dict(time = 0.5,  feedback_level=rrc.FeedbackLevel.DONE), action_id = id))

#send to approach place plane
frame = plane_to_compas_frame(approach_place_plane)
frame_rob = robot.from_tcf_to_t0cf([frame])[0]
scaled_frame = frame_rob.transformed(S)
id +=1
actions.append(Action('MoveToFrame', dict(frame= scaled_frame, speed=speed, zone=rrc.Zone.FINE, motion_type='rrc.Motion.LINEAR',feedback_level=rrc.FeedbackLevel.DONE), action_id = id))

#send above pickup with configuration
id +=1
actions.append(Action('PrintText', dict(text='Send Robot to pick up station?'), action_id = id))
id +=1
actions.append(Action('Stop', dict(), action_id = id))

#REVERSE?
for configuration in configurations_pick_to_place[::-1]:
    temp = []
    for n,j in zip(configuration.joint_names,configuration.joint_values):
        if n == str(selected_robot)+"_joint_1":
            temp.append(j)
    for n,j in zip(configuration.joint_names,configuration.joint_values):
        if n == str(selected_robot)+"_joint_2":
            temp.append(j)
    for n,j in zip(configuration.joint_names,configuration.joint_values):
        if n == str(selected_robot)+"_joint_3":
            temp.append(j)
    for n,j in zip(configuration.joint_names,configuration.joint_values):
        if n == str(selected_robot)+"_joint_4":
            temp.append(j)
    for n,j in zip(configuration.joint_names,configuration.joint_values):
        if n == str(selected_robot)+"_joint_5":
            temp.append(j)
    for n,j in zip(configuration.joint_names,configuration.joint_values):
        if n == str(selected_robot)+"_joint_6":
            temp.append(j)

    joints = [math.degrees(j) for j in temp]
    #print joints
    id +=1
    actions.append(Action('MoveToJoints', dict(joints = joints, ext_axes = [], speed=speed, zone= 5, feedback_level=rrc.FeedbackLevel.DONE), action_id = id))


production_data = ProductionData(actions)

if export:
    with open(file_path, 'w') as fp:
        compas.json_dump(production_data.to_data(), fp)
# ---------- end send ----------

# ----
# EXPORT
panel_10 = Panel("robotA")
approach_placing_plane_robota = Plane(Plane(origin=(0.3943346491, 0.04049411799, 0.3676446038), x=(-0.024578009, -0.0007541304728, 0.9996976307), y=(0.3137178998, -0.9494904562, 0.006996637247)))
robota_approach_place_config = Data()
robota_pick_approach_config = Data()
robota_place_plane = Plane()
export_2 = Button()
robota_pickup_plane = Plane()
concatenate_2 = Concatenate(FragmentA=panel_10)
send_2 = GhPythonScript(
    approach_pickup_config=robota_pick_approach_config,
    approach_place_plane=approach_placing_plane_robota,
    pickup_plane=robota_pickup_plane,
    approach_place_config=robota_approach_place_config,
    place_plane=robota_place_plane,
    export=export_2,
    speed=Slider(83, range=0..83),
    file_name="robotA_place_stick00",
    selected_robot=concatenate_2)  # -> actions; inputs approach_place_plane: Plane, pickup_plane: Plane, configurations_pick_to_place: list; same code as send

# ----
# ATTACHED
attached_collision_beam = Geometry(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)
mesh_brep_2 = MeshBrep(
    Brep=attached_collision_beam,
    Settings={GridMaxCount=0, GridMinCount=16, JaggedSeams=False, MaxEdgeLength=0, MinEdgeLength=0.0001, MinTolerance=0, Refine=True, RefineAngle=0, RelativeTolerance=0.65, SimplePlanes=True, Tolerance=0})

# ----
# TOOL attachment
number_slider_7 = Slider(0.102, range=0..1)
unit_z_4 = UnitZ(Factor=number_slider_7)
xy_plane_5 = XYPlane(Origin=Point(0, 0, 0))
move_4 = Move(Geometry=xy_plane_5, Motion=unit_z_4)  # -> Geometry, Transform
gripper = Mesh(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)

unit_z_5 = UnitZ(Factor=number_slider_7)
move_5 = Move(Geometry=mesh_brep_2, Motion=unit_z_5)  # -> Geometry, Transform

rotate_2 = Rotate(Geometry=gripper, Angle=degrees(number_slider_4), Plane=PlaneXY(0, 0, 0))  # -> Geometry, Transform
rotate_3 = Rotate(Geometry=move_4.Geometry, Angle=degrees(number_slider_4), Plane=PlaneXY(0, 0, 0))  # -> Geometry, Transform

transform_3 = Transform(Geometry=rotate.Geometry, Transform=transformation_from_a_to_b.a_2_b)
tool = AttachedTool(robot=ros_robot, visual_mesh=rotate_2.Geometry, collision_mesh=transform_3, tcf_plane=rotate_3.Geometry, group="robot_B")  # -> robot; inputs visual_mesh: Mesh, collision_mesh: Mesh
#   port visual_mesh: A visual mesh for the tool.
#   port collision_mesh: A collision mesh for the tool.
#   port tcf_plane: The frame of the tool in tool0 frame.
#   port group: The planning group to which the tool should be attached.
# ---------- tool: Python ----------
"""
Attach a tool to the robot.

COMPAS FAB v0.27.0
"""
from ghpythonlib.componentbase import executingcomponent as component
from compas_rhino.conversions import RhinoMesh
from compas_rhino.conversions import plane_to_compas_frame

from compas.geometry import Frame
from compas_fab.robots import Tool


class AttachToolComponent(component):
    def RunScript(self, robot, visual_mesh, collision_mesh, tcf_plane, group):
        if robot and robot.client and robot.client.is_connected and visual_mesh:
            if not collision_mesh:
                collision_mesh = visual_mesh

            c_visual_mesh = RhinoMesh.from_geometry(visual_mesh).to_compas()
            c_collision_mesh = RhinoMesh.from_geometry(collision_mesh).to_compas()

            if not tcf_plane:
                frame = Frame.worldXY()
            else:
                frame = plane_to_compas_frame(tcf_plane)
            tool = Tool(c_visual_mesh, frame, c_collision_mesh)

            robot.attach_tool(tool, group)

        return robot
# ---------- end tool ----------

tool_2 = AttachedTool(
    robot=ros_robot,
    visual_mesh=rotate_2.Geometry,
    collision_mesh=rotate.Geometry,
    tcf_plane=rotate_3.Geometry,
    group="robot_A")  # -> robot; inputs visual_mesh: Mesh, collision_mesh: Mesh; same code as tool

robot_visualize = RobotVisualize(robot=tool, configuration=zero_config_4)  # -> visual, collision, collision_meshes, attached_meshes, frames, base_frame, ee_frame; inputs show_visual: Boolean, show_collision: Boolean, show_frames: Boolean, show_base_frame: Boolean, show_end_effector_frame: Boolean, show_cm: Boolean, show_acm: Boolean
#   port group: The planning group used for end-effector and base visualization.
#   port configuration: The robot's full configuration.
#   port show_visual: Whether or not to show the robot's visual meshes.
#   port show_collision: Whether or not to show the robot's collision meshes.
#   port show_frames: Whether or not to show the robot's joint frames.
#   port show_base_frame: Whether or not to show the robot's base frame.
#   port show_end_effector_frame: Whether or not to show the robot's end-effector frame.
#   port show_cm: Whether or not to show the collision meshes (if any).
#   port show_acm: Whether or not to show the attached collision meshes (if any).
#   port visual: Rhino meshes of the robot's visual geometry (if any).
#   port collision: Rhino meshes of the robot's collision geometry (if any).
#   port collision_meshes: Rhino meshes of the scene's collision meshes (if any).
#   port attached_meshes: Rhino meshes of the scene's attached collision meshes (if any).
#   port frames: The robot's joint frames as Rhino planes (if any).
#   port base_frame: The robot's base frame as a Rhino plane (if any).
#   port ee_frame: The robot's end-effector frame as a Rhino plane (if any).
# ---------- robot_visualize: Python ----------
"""
Visualizes the robot.

COMPAS FAB v0.27.0
"""
from compas.artists import Artist
from compas.geometry import Frame
from compas.geometry import Transformation
from compas_fab.robots import PlanningScene
from ghpythonlib.componentbase import executingcomponent as component


class RobotVisualize(component):
    def RunScript(
        self,
        robot,
        group,
        configuration,
        show_visual,
        show_collision,
        show_frames,
        show_base_frame,
        show_end_effector_frame,
        show_cm,
        show_acm,
    ):

        visual = None
        collision = None
        collision_meshes = None
        attached_meshes = None
        frames = None
        base_frame = None
        ee_frame = None

        if robot:
            show_visual = True if show_visual is None else show_visual
            show_cm = True if show_cm is None else show_cm
            show_acm = True if show_acm is None else show_acm
            configuration = configuration or robot.zero_configuration()

            robot.update(configuration, visual=show_visual, collision=show_collision)
            compas_frames = robot.transformed_frames(configuration, group)

            if show_visual:
                visual = robot.artist.draw_visual()

            if show_collision:
                collision = robot.artist.draw_collision()

            if show_base_frame:
                base_compas_frame = compas_frames[0]
                artist = Artist(base_compas_frame)
                base_frame = artist.draw()

            if show_end_effector_frame:
                ee_compas_frame = robot.forward_kinematics(
                    configuration, group, options=dict(solver="model")
                )
                artist = Artist(ee_compas_frame)
                ee_frame = artist.draw()

            if show_frames:
                frames = []
                for compas_frame in compas_frames[1:]:
                    artist = Artist(compas_frame)
                    frame = artist.draw()
                    frames.append(frame)

            if show_cm or show_acm:
                scene = PlanningScene(robot)
                scene = robot.client.get_planning_scene()

                collision_meshes = []
                attached_meshes = []

                if show_cm:
                    for co in scene.world.collision_objects:
                        header = co.header
                        frame_id = header.frame_id
                        cms = co.to_collision_meshes()

                        for cm in cms:
                            if cm.frame != Frame.worldXY():
                                t = Transformation.from_frame(cm.frame)
                                mesh = cm.mesh.transformed(t)
                            else:
                                mesh = cm.mesh

                            collision_meshes.append(Artist(mesh).draw())

                if show_acm:
                    for aco in scene.robot_state.attached_collision_objects:
                        for acm in aco.to_attached_collision_meshes():
                            frame_id = aco.object["header"]["frame_id"]
                            frame = robot.forward_kinematics(
                                configuration, options=dict(link=frame_id)
                            )
                            t = Transformation.from_frame(frame)

                            # Local CM frame
                            if (
                                acm.collision_mesh.frame
                                and acm.collision_mesh.frame != Frame.worldXY()
                            ):
                                t = t * Transformation.from_frame(
                                    acm.collision_mesh.frame
                                )

                            mesh = acm.collision_mesh.mesh.transformed(t)

                            attached_meshes.append(Artist(mesh).draw())

        return (
            visual,
            collision,
            collision_meshes,
            attached_meshes,
            frames,
            base_frame,
            ee_frame,
        )
# ---------- end robot_visualize ----------

relay = Relay()
list_item = ListItem(List=relay, Index=0, Wrap=True)
ghpython_script = GhPythonScript(robot=tool_2, conf=list_item, group="robot_A")  # -> out, a
# ---------- ghpython_script: Python ----------
config_A = robot.zero_configuration(group = "robot_A")

config_B = robot.zero_configuration(group = "robot_B")

rob = ""

if group == "robot_A":
    rob = "robotA"
elif group =="robot_B":
    rob = "robotB"
    
join_values= []

for n,j in zip(conf.joint_names,conf.joint_values):
    if n == str(rob)+"_joint_1":
        join_values.append(j)
for n,j in zip(conf.joint_names,conf.joint_values):
    if n == str(rob)+"_joint_2":
        join_values.append(j)
for n,j in zip(conf.joint_names,conf.joint_values):
    if n == str(rob)+"_joint_3":
        join_values.append(j)
for n,j in zip(conf.joint_names,conf.joint_values):
    if n == str(rob)+"_joint_4":
        join_values.append(j)
for n,j in zip(conf.joint_names,conf.joint_values):
    if n == str(rob)+"_joint_5":
        join_values.append(j)
for n,j in zip(conf.joint_names,conf.joint_values):
    if n == str(rob)+"_joint_6":
        join_values.append(j)

if group=="robot_A":
    config_A.joint_values = join_values
    a = config_B.merged(config_A)
elif group=="robot_B":
    config_B.joint_values = join_values
    a = config_A.merged(config_B)
# ---------- end ghpython_script ----------
merge = Merge(Data1=flatten(relay), Data2=flatten(ghpython_script.a))
list_length = ListLength(List=merge)
run = BooleanToggle(True)
python = PythonScript(Run=run, Target=list_length, Interval=Slider(25, range=1..1000))  # -> Counter; inputs Run: Boolean
# ---------- python: Python ----------
import Grasshopper as gh

def updateComponent(interval):
    
    """ Update this component similar to using a grasshopper timer """
    
    def callBack(e):
        ghenv.Component.ExpireSolution(False)
        
    ghenv.Component.OnPingDocument().ScheduleSolution(interval,
    gh.Kernel.GH_Document.GH_ScheduleDelegate(callBack))

Target = Target-1

# Instantiate or reset persistent counter variable
if "count" not in globals() or not Run:
    count = 0

# Update the variable and component
if Run:
    if count < Target:
        count +=1
        updateComponent(Interval)
    elif count == Target:
        count = 0

# Output counter
if count == 0:
    Counter = Target
else:
    Counter = count
# ---------- end python ----------
item = ListItem(List=merge, Index=python, Wrap=True)
panel_11 = Panel(python)
robot_visualize_2 = RobotVisualize(
    robot=tool_2,
    acm=move_5.Geometry,
    group="robot_A",
    configuration=item,
    show_frames=Toggle(False),
    show_end_effector_frame=Toggle(True),
    show_cm=Toggle(True),
    show_acm=Toggle(True),
    t0cf_2_tcp=number_slider_7)  # -> visual, collision, collision_meshes, attached_meshes, frames, base_frame, ee_frame; inputs acm: Mesh, show_visual: Boolean, show_collision: Boolean, show_frames: Boolean, show_base_frame: Boolean, show_end_effector_frame: Boolean, show_cm: Boolean, show_acm: Boolean
#   port group: The planning group used for end-effector and base visualization.
#   port configuration: The robot's full configuration.
#   port show_visual: Whether or not to show the robot's visual meshes.
#   port show_collision: Whether or not to show the robot's collision meshes.
#   port show_frames: Whether or not to show the robot's joint frames.
#   port show_base_frame: Whether or not to show the robot's base frame.
#   port show_end_effector_frame: Whether or not to show the robot's end-effector frame.
#   port show_cm: Whether or not to show the collision meshes (if any).
#   port show_acm: Whether or not to show the attached collision meshes (if any).
#   port visual: Rhino meshes of the robot's visual geometry (if any).
#   port collision: Rhino meshes of the robot's collision geometry (if any).
#   port collision_meshes: Rhino meshes of the scene's collision meshes (if any).
#   port attached_meshes: Rhino meshes of the scene's attached collision meshes (if any).
#   port frames: The robot's joint frames as Rhino planes (if any).
#   port base_frame: The robot's base frame as a Rhino plane (if any).
#   port ee_frame: The robot's end-effector frame as a Rhino plane (if any).
# ---------- robot_visualize_2: Python ----------
"""
Visualizes the robot.

COMPAS FAB v0.27.0
"""
from compas.artists import Artist
from compas.geometry import Frame
from compas.geometry import Transformation
from compas_fab.robots import PlanningScene
from ghpythonlib.componentbase import executingcomponent as component
from compas_fab.robots import AttachedCollisionMesh
import Rhino.Geometry as rg


class RobotVisualize(component):
    def RunScript(
        self,
        robot,
        acm,
        group,
        configuration,
        show_visual,
        show_collision,
        show_frames,
        show_base_frame,
        show_end_effector_frame,
        show_cm,
        show_acm,
        t0cf_2_tcp
    ):

        visual = None
        collision = None
        collision_meshes = None
        attached_meshes = None
        frames = None
        base_frame = None
        ee_frame = None

        if robot:
            show_visual = True if show_visual is None else show_visual
            show_cm = True if show_cm is None else show_cm
            show_acm = True if show_acm is None else show_acm
            configuration = configuration or robot.zero_configuration()

            robot.update(configuration, visual=show_visual, collision=show_collision)
            compas_frames = robot.transformed_frames(configuration, group)

            if show_visual:
                visual = robot.artist.draw_visual()

            if show_collision:
                collision = robot.artist.draw_collision()

            if show_base_frame:
                base_compas_frame = compas_frames[0]
                artist = Artist(base_compas_frame)
                base_frame = artist.draw()

            if show_end_effector_frame:
                ee_compas_frame = robot.forward_kinematics(
                    configuration, group, options=dict(solver="model")
                )
                artist = Artist(ee_compas_frame)
                ee_frame = artist.draw()

            if show_frames:
                frames = []
                for compas_frame in compas_frames[1:]:
                    artist = Artist(compas_frame)
                    frame = artist.draw()
                    frames.append(frame)

            if show_cm or show_acm:
                scene = PlanningScene(robot)
                scene = robot.client.get_planning_scene()

                collision_meshes = []
                attached_meshes = []

                if show_cm:
                    for co in scene.world.collision_objects:
                        header = co.header
                        frame_id = header.frame_id
                        cms = co.to_collision_meshes()

                        for cm in cms:
                            if cm.frame != Frame.worldXY():
                                t = Transformation.from_frame(cm.frame)
                                mesh = cm.mesh.transformed(t)
                            else:
                                mesh = cm.mesh

                            collision_meshes.append(Artist(mesh).draw())

                if show_acm:
                    trans = rg.Transform.PlaneToPlane(rg.Plane.WorldXY, ee_frame)
                    acm.Transform(trans)
                    vec = ee_frame.Normal
                    vec.Unitize()
                    vec *= t0cf_2_tcp
                    trans2 = rg.Transform.Translation(-vec)
                    acm.Transform(trans2)
        return (
            visual,
            collision,
            collision_meshes,
            acm,
            frames,
            base_frame,
            ee_frame,
        )
# ---------- end robot_visualize_2 ----------
mesh = Mesh(robot_visualize_2.attached_meshes)

deconstruct_brep = DeconstructBrep()  # -> Faces, Edges, Vertices
length = Length(Curve=deconstruct_brep.Edges)
sort_list = SortList(Keys=length, ValuesValuesA=deconstruct_brep.Edges)  # -> Keys, ValuesValuesA
list_item_2 = ListItem(List=sort_list.ValuesValuesA, Index="-1", Wrap=True)

mesh_surface = MeshSurface(Surface=deconstruct_brep.Faces, UCount=number_slider_2, VCount=number_slider_2, Overhang=True, Equalize=False)

ghpython_script_2 = GhPythonScript(mesh=mesh_surface, edges=sort_list.ValuesValuesA)  # -> plane, move; inputs mesh: list of Mesh, edges: list of Line
# ---------- ghpython_script_2: Python ----------
import Rhino.Geometry as rg

centroids = []
area = []
indices = []

for i,m in enumerate(mesh):
    
    indices.append(i)
    centroid = rg.Point3d(0,0,0)
    for v in m.Vertices:
        centroid += rg.Point3d(v.X, v.Y, v.Z)

    centroids.append(centroid/len(m.Vertices))
    print len(m.Vertices)
    area.append(rg.AreaMassProperties.Compute(m).Area)

zipped_lists = zip(area, centroid, indices)
sorted_pairs = sorted(zipped_lists)

sorted_area, sorted_centroid, indices = zip(*sorted_pairs)

pt1 = centroids[indices[0]]
pt2 = centroids[indices[1]]
axis = rg.Line(rg.Point3d(pt1.X, pt1.Y, pt1.Z), rg.Point3d(pt2.X, pt2.Y, pt2.Z))


origin = axis.PointAt(0.5)
xaxis = edges[6].PointAt(1) - edges[6].PointAt(0)
yaxis = edges[-1].PointAt(1) - edges[-1].PointAt(0)

plane = rg.Plane(origin, xaxis, yaxis)
# ---------- end ghpython_script_2 ----------

# ----
# Adjustment for different pick
value_list = ValueList({"One Side": -1, "Center": 0, "Other Side": 1}, selected="Center")
multiplication = Multiplication(A=value_list, B=ghpython_script_2.move)
amplitude = Amplitude(Vector=list_item_2, Amplitude=multiplication)
move_6 = Move(Geometry=ghpython_script_2.plane, Motion=amplitude)  # -> Geometry, Transform

approaching_vector = ValueList({"Plane Z Axis": 0, "Plane X Axis": 1, "Plane Y Axis": 2, "World Z Axis": 3, "World X Axis": 4, "World Y Axis": 5}, selected="World Z Axis")
plane_orienatation = ValueList({"x , y": 0, "-x , y": 1, "y , z": 2, "-y, z": 3, "z , y": 4, "-z , y": 5}, selected="-y, z")
ghpython_script_3 = GhPythonScript(
    plane=move_6.Geometry,
    plane_orientation=plane_orienatation,
    approach_direction=approaching_vector,
    approach_distance=Slider(0.1, range=-1.95..1.2))  # -> out, placing_plane, approach_placing_plane; inputs plane: Plane
# ---------- ghpython_script_3: Python ----------
import Rhino.Geometry as rg

a = rg.Plane(plane.Origin, plane.XAxis, plane.YAxis)

b = rg.Plane(plane.Origin, - plane.XAxis, plane.YAxis)

c = rg.Plane(plane.Origin, plane.YAxis, plane.ZAxis)

d = rg.Plane(plane.Origin, - plane.YAxis, plane.ZAxis)

e = rg.Plane(plane.Origin, a.ZAxis, a.YAxis)

f = rg.Plane(plane.Origin, b.ZAxis, b.YAxis)

if plane_orientation == 0:
    placing_plane = a
elif plane_orientation == 1:
    placing_plane = b
elif plane_orientation == 2:
    placing_plane = c
elif plane_orientation == 3:
    placing_plane = d
elif plane_orientation == 4:
    placing_plane = e
else:
    placing_plane = f
    
if approach_direction == 0:
    vec = placing_plane.ZAxis
elif approach_direction == 1:
    vec = placing_plane.XAxis
elif approach_direction == 2:
    vec = placing_plane.YAxis
elif approach_direction == 3:
    vec = rg.Vector3d.ZAxis
elif approach_direction == 4:
    vec = rg.Vector3d.XAxis
else:
    vec = rg.Vector3d.YAxis
    
vec.Unitize()
vec *= approach_distance
approach_placing_plane = rg.Plane(placing_plane.Origin, placing_plane.XAxis, placing_plane.YAxis)
approach_placing_plane.Translate(vec)
# ---------- end ghpython_script_3 ----------

orient = Orient(Geometry=attached_collision_beam, Source=xy_plane, Target=ghpython_script_3.placing_plane)  # -> Geometry, Transform
point_3 = Point(ghpython_script_3.placing_plane)

# ----
# PLACE ROBOT A
# place plane
# approach place config
flip_plane_3 = FlipPlane(Plane=ghpython_script_3.placing_plane, FlipX=False, FlipY=False, FlipZ=boolean_toggle)  # -> Flipped, ResultBoolean

deconstruct_brep_2 = DeconstructBrep()  # -> Faces, Edges, Vertices
length_2 = Length(Curve=deconstruct_brep_2.Edges)
sort_list_2 = SortList(Keys=length_2, ValuesValuesA=deconstruct_brep_2.Edges)  # -> Keys, ValuesValuesA
list_item_3 = ListItem(List=sort_list_2.ValuesValuesA, Index="-1", Wrap=True)

mesh_surface_2 = MeshSurface(Surface=deconstruct_brep_2.Faces, UCount=number_slider_3, VCount=number_slider_3, Overhang=True, Equalize=False)

ghpython_script_4 = GhPythonScript(mesh=mesh_surface_2, edges=sort_list_2.ValuesValuesA)  # -> plane, move; inputs mesh: list of Mesh, edges: list of Line; same code as ghpython_script_2

# ----
# Adjustment for different pick
value_list_2 = ValueList({"One Side": -1, "Center": 0, "Other Side": 1}, selected="Center")
multiplication_2 = Multiplication(A=value_list_2, B=ghpython_script_4.move)
amplitude_2 = Amplitude(Vector=list_item_3, Amplitude=multiplication_2)
move_7 = Move(Geometry=ghpython_script_4.plane, Motion=amplitude_2)  # -> Geometry, Transform

approaching_vector_2 = ValueList({"Plane Z Axis": 0, "Plane X Axis": 1, "Plane Y Axis": 2, "World Z Axis": 3, "World X Axis": 4, "World Y Axis": 5}, selected="Plane Z Axis")
plane_orienatation_2 = ValueList({"x , y": 0, "-x , y": 1, "y , z": 2, "-y, z": 3, "z , y": 4, "-z , y": 5, "x , z": 6, "-x , z": 7}, selected="y , z")
ghpython_script_5 = GhPythonScript(
    plane=move_7.Geometry,
    plane_orientation=plane_orienatation_2,
    approach_direction=approaching_vector_2,
    approach_distance=Slider(0.1, range=-1.95..1.2))  # -> out, placing_plane, approach_placing_plane; inputs plane: Plane
# ---------- ghpython_script_5: Python ----------
import Rhino.Geometry as rg

a = rg.Plane(plane.Origin, plane.XAxis, plane.YAxis)

b = rg.Plane(plane.Origin, - plane.XAxis, plane.YAxis)

c = rg.Plane(plane.Origin, plane.YAxis, plane.ZAxis)

d = rg.Plane(plane.Origin, - plane.YAxis, plane.ZAxis)

e = rg.Plane(plane.Origin, a.ZAxis, a.YAxis)

f = rg.Plane(plane.Origin, b.ZAxis, b.YAxis)

g = rg.Plane(plane.Origin, plane.XAxis, plane.ZAxis)

h = rg.Plane(plane.Origin, - plane.XAxis, plane.ZAxis)


if plane_orientation == 0:
    placing_plane = a
elif plane_orientation == 1:
    placing_plane = b
elif plane_orientation == 2:
    placing_plane = c
elif plane_orientation == 3:
    placing_plane = d
elif plane_orientation == 4:
    placing_plane = e
elif plane_orientation == 5:
    placing_plane = f
elif plane_orientation == 6:
    placing_plane = g
else:
    placing_plane = h
    
    
if approach_direction == 0:
    vec = placing_plane.ZAxis
elif approach_direction == 1:
    vec = placing_plane.XAxis
elif approach_direction == 2:
    vec = placing_plane.YAxis
elif approach_direction == 3:
    vec = rg.Vector3d.ZAxis
elif approach_direction == 4:
    vec = rg.Vector3d.XAxis
else:
    vec = rg.Vector3d.YAxis
    
vec.Unitize()
vec *= approach_distance
approach_placing_plane = rg.Plane(placing_plane.Origin, placing_plane.XAxis, placing_plane.YAxis)
approach_placing_plane.Translate(vec)
# ---------- end ghpython_script_5 ----------

orient_2 = Orient(Geometry=attached_collision_beam, Source=xy_plane_2, Target=ghpython_script_5.placing_plane)  # -> Geometry, Transform
point_4 = Point(ghpython_script_5.placing_plane)

# ----
# place plane
# approach place config
# approach place plane
flip_plane_4 = FlipPlane(Plane=ghpython_script_5.approach_placing_plane, FlipX=False, FlipY=False, FlipZ=True)  # -> Flipped, ResultBoolean

relay_2 = Relay()
list_item_4 = ListItem(List=relay_2, Index=0, Wrap=True)
run_2 = BooleanToggle(True)

# ----
# MOTION PLANNING B
# attached element
panel_12 = Panel("robot_B")

ghpython_script_6 = GhPythonScript(robot=tool, conf=list_item_4, group=panel_12)  # -> out, a; same code as ghpython_script
merge_2 = Merge(Data1=flatten(relay_2), Data2=flatten(ghpython_script_6.a))
list_length_2 = ListLength(List=merge_2)
python_2 = PythonScript(Run=run_2, Target=list_length_2, Interval=Slider(25, range=1..1000))  # -> Counter; inputs Run: Boolean; same code as python
item_2 = ListItem(List=merge_2, Index=python_2, Wrap=True)
panel_13 = Panel(python_2)
robot_visualize_3 = RobotVisualize(
    robot=tool,
    acm=move_5.Geometry,
    group="robot_B",
    configuration=item_2,
    show_frames=Toggle(False),
    show_end_effector_frame=Toggle(True),
    show_cm=Toggle(True),
    show_acm=Toggle(True),
    t0cf_2_tcp=number_slider_7)  # -> visual, collision, collision_meshes, attached_meshes, frames, base_frame, ee_frame; inputs acm: Mesh, show_visual: Boolean, show_collision: Boolean, show_frames: Boolean, show_base_frame: Boolean, show_end_effector_frame: Boolean, show_cm: Boolean, show_acm: Boolean; same code as robot_visualize_2
mesh_2 = Mesh(robot_visualize_3.attached_meshes)

geometry_3 = Geometry(robot_visualize_3.ee_frame)
