# Grasshopper definition planning_template.gh (Grasshopper 1.0.7)

number_slider = Slider(0.008, range=0..0.1)
# PICK ROBOT A
# ROBOT
# pick config
# pick plane
# ZERO Configs
# approach pick config
# approach pick plane
# PLACE ROBOT A
# ELEMENTS
# place plane
# place config
# approach place config
# approach place plane
# SCENE
# PICK ROBOT B
number_slider_2 = Slider(0.005, range=0..0.1)
# BUILDING BLOCK
number_slider_3 = Slider(0.025, range=0..0.1)

# ----
# TRANSFORM A<->B
# DESIGN
transformation_from_a_to_b = GhPythonScript()  # -> a_2_b, b_2_a
# ---------- transformation_from_a_to_b: Python ----------
import Rhino.Geometry as rg
import math

# Transformation matrix inputs
x = 0.5347479398223676
y = -0.7939334915306736
z = 0.0007630697140932686
r = 0.00801613165265005  # Roll
p = -0.0064154595608891625 # Pitch
yaw = 3.133456800610911  # Yaw

# Compute rotation matrix
cos_r, sin_r = math.cos(r), math.sin(r)
cos_p, sin_p = math.cos(p), math.sin(p)
cos_y, sin_y = math.cos(yaw), math.sin(yaw)

# Rotation matrix components
m00 = cos_y * cos_p
m01 = cos_y * sin_p * sin_r - sin_y * cos_r
m02 = cos_y * sin_p * cos_r + sin_y * sin_r
m10 = sin_y * cos_p
m11 = sin_y * sin_p * sin_r + cos_y * cos_r
m12 = sin_y * sin_p * cos_r - cos_y * sin_r
m20 = -sin_p
m21 = cos_p * sin_r
m22 = cos_p * cos_r

# Create Rhino Transform object
rotation_matrix = rg.Transform.Identity
rotation_matrix.M00 = m00
rotation_matrix.M01 = m01
rotation_matrix.M02 = m02
rotation_matrix.M10 = m10
rotation_matrix.M11 = m11
rotation_matrix.M12 = m12
rotation_matrix.M20 = m20
rotation_matrix.M21 = m21
rotation_matrix.M22 = m22

# Add translation
rotation_matrix.M03 = x
rotation_matrix.M13 = y
rotation_matrix.M23 = z


# Compute inverse
success, inverse_matrix = rg.Transform.TryGetInverse(rotation_matrix)

# Output
a_2_b = rotation_matrix
b_2_a = inverse_matrix if success else None  # Return None if inversion fails
# ---------- end transformation_from_a_to_b ----------
# Load Robot
# TOOL attachment
info = Info()  # -> info
#   port info: Environment info.
# ---------- info: Python ----------
"""
Displays information about the active COMPAS environment.
"""
import compas_bootstrapper
from ghpythonlib.componentbase import executingcomponent as component

import compas
import compas_fab


class CompasInfo(component):
    def RunScript(self):
        self.Message = 'COMPAS v{}'.format(compas.__version__)
        info = 'COMPAS Version: {}\nEnvironment: {}\nCOMPAS FAB Version:{}'
        return (info.format(compas.__version__, compas_bootstrapper.ENVIRONMENT_NAME,compas_fab.__version__))
# ---------- end info ----------
# Package Version: COMPAS Version: 1.17.10
# Environment: design6197
# COMPAS FAB Version:0.27.0
your_version = Panel(info)
gripper_lowpoly = Mesh(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)
gripper = Mesh(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)

# ----
# Labeled Robots
labels = Geometry([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])

# ----
# MOTION PLANNING A
# trajectory
relay = Relay()  # disabled
# attached element
list_item = ListItem(List=relay, Index=0, Wrap=True)  # disabled
# pick config
# pick plane
panel = Panel("robot_A")  # disabled
ghpython_script = GhPythonScript(conf=list_item, group=panel)  # -> out, a; disabled
# ---------- ghpython_script: Python ----------
config_A = robot.zero_configuration(group = "robot_A")

config_B = robot.zero_configuration(group = "robot_B")

rob = ""

if group == "robot_A":
    rob = "robotA"
elif group =="robot_B":
    rob = "robotB"
    
join_values= []

for n,j in zip(conf.joint_names,conf.joint_values):
    if n == str(rob)+"_joint_1":
        join_values.append(j)
for n,j in zip(conf.joint_names,conf.joint_values):
    if n == str(rob)+"_joint_2":
        join_values.append(j)
for n,j in zip(conf.joint_names,conf.joint_values):
    if n == str(rob)+"_joint_3":
        join_values.append(j)
for n,j in zip(conf.joint_names,conf.joint_values):
    if n == str(rob)+"_joint_4":
        join_values.append(j)
for n,j in zip(conf.joint_names,conf.joint_values):
    if n == str(rob)+"_joint_5":
        join_values.append(j)
for n,j in zip(conf.joint_names,conf.joint_values):
    if n == str(rob)+"_joint_6":
        join_values.append(j)

if group=="robot_A":
    config_A.joint_values = join_values
    a = config_B.merged(config_A)
elif group=="robot_B":
    config_B.joint_values = join_values
    a = config_A.merged(config_B)
# ---------- end ghpython_script ----------
merge = Merge(Data1=flatten(relay), Data2=flatten(ghpython_script.a))  # disabled
number_slider_4 = Slider(25, range=1..1000)  # disabled
list_length = ListLength(List=merge)  # disabled
run = BooleanToggle(True)  # disabled
python = PythonScript(Run=run, Target=list_length, Interval=number_slider_4)  # -> Counter; inputs Run: Boolean; disabled
# ---------- python: Python ----------
import Grasshopper as gh

def updateComponent(interval):
    
    """ Update this component similar to using a grasshopper timer """
    
    def callBack(e):
        ghenv.Component.ExpireSolution(False)
        
    ghenv.Component.OnPingDocument().ScheduleSolution(interval,
    gh.Kernel.GH_Document.GH_ScheduleDelegate(callBack))

Target = Target-1

# Instantiate or reset persistent counter variable
if "count" not in globals() or not Run:
    count = 0

# Update the variable and component
if Run:
    if count < Target:
        count +=1
        updateComponent(Interval)
    elif count == Target:
        count = 0

# Output counter
if count == 0:
    Counter = Target
else:
    Counter = count
# ---------- end python ----------
item = ListItem(List=merge, Index=python, Wrap=True)  # disabled
panel_2 = Panel(python)  # disabled
boolean_toggle = BooleanToggle(False)  # disabled
boolean_toggle_2 = BooleanToggle(True)  # disabled
boolean_toggle_3 = BooleanToggle(True)  # disabled
boolean_toggle_4 = BooleanToggle(True)  # disabled
panel_3 = Panel("robot_A")  # disabled
robot_visualize = RobotVisualize(
    group=panel_3,
    configuration=item,
    show_frames=boolean_toggle,
    show_end_effector_frame=boolean_toggle_2,
    show_cm=boolean_toggle_3,
    show_acm=boolean_toggle_4)  # -> visual, collision, collision_meshes, attached_meshes, frames, base_frame, ee_frame; inputs acm: Mesh, show_visual: Boolean, show_collision: Boolean, show_frames: Boolean, show_base_frame: Boolean, show_end_effector_frame: Boolean, show_cm: Boolean, show_acm: Boolean; disabled
#   port group: The planning group used for end-effector and base visualization.
#   port configuration: The robot's full configuration.
#   port show_visual: Whether or not to show the robot's visual meshes.
#   port show_collision: Whether or not to show the robot's collision meshes.
#   port show_frames: Whether or not to show the robot's joint frames.
#   port show_base_frame: Whether or not to show the robot's base frame.
#   port show_end_effector_frame: Whether or not to show the robot's end-effector frame.
#   port show_cm: Whether or not to show the collision meshes (if any).
#   port show_acm: Whether or not to show the attached collision meshes (if any).
#   port visual: Rhino meshes of the robot's visual geometry (if any).
#   port collision: Rhino meshes of the robot's collision geometry (if any).
#   port collision_meshes: Rhino meshes of the scene's collision meshes (if any).
#   port attached_meshes: Rhino meshes of the scene's attached collision meshes (if any).
#   port frames: The robot's joint frames as Rhino planes (if any).
#   port base_frame: The robot's base frame as a Rhino plane (if any).
#   port ee_frame: The robot's end-effector frame as a Rhino plane (if any).
# ---------- robot_visualize: Python ----------
"""
Visualizes the robot.

COMPAS FAB v0.27.0
"""
from compas.artists import Artist
from compas.geometry import Frame
from compas.geometry import Transformation
from compas_fab.robots import PlanningScene
from ghpythonlib.componentbase import executingcomponent as component
from compas_fab.robots import AttachedCollisionMesh
import Rhino.Geometry as rg


class RobotVisualize(component):
    def RunScript(
        self,
        robot,
        acm,
        group,
        configuration,
        show_visual,
        show_collision,
        show_frames,
        show_base_frame,
        show_end_effector_frame,
        show_cm,
        show_acm,
        t0cf_2_tcp
    ):

        visual = None
        collision = None
        collision_meshes = None
        attached_meshes = None
        frames = None
        base_frame = None
        ee_frame = None

        if robot:
            show_visual = True if show_visual is None else show_visual
            show_cm = True if show_cm is None else show_cm
            show_acm = True if show_acm is None else show_acm
            configuration = configuration or robot.zero_configuration()

            robot.update(configuration, visual=show_visual, collision=show_collision)
            compas_frames = robot.transformed_frames(configuration, group)

            if show_visual:
                visual = robot.artist.draw_visual()

            if show_collision:
                collision = robot.artist.draw_collision()

            if show_base_frame:
                base_compas_frame = compas_frames[0]
                artist = Artist(base_compas_frame)
                base_frame = artist.draw()

            if show_end_effector_frame:
                ee_compas_frame = robot.forward_kinematics(
                    configuration, group, options=dict(solver="model")
                )
                artist = Artist(ee_compas_frame)
                ee_frame = artist.draw()

            if show_frames:
                frames = []
                for compas_frame in compas_frames[1:]:
                    artist = Artist(compas_frame)
                    frame = artist.draw()
                    frames.append(frame)

            if show_cm or show_acm:
                scene = PlanningScene(robot)
                scene = robot.client.get_planning_scene()

                collision_meshes = []
                attached_meshes = []

                if show_cm:
                    for co in scene.world.collision_objects:
                        header = co.header
                        frame_id = header.frame_id
                        cms = co.to_collision_meshes()

                        for cm in cms:
                            if cm.frame != Frame.worldXY():
                                t = Transformation.from_frame(cm.frame)
                                mesh = cm.mesh.transformed(t)
                            else:
                                mesh = cm.mesh

                            collision_meshes.append(Artist(mesh).draw())

                if show_acm:
                    trans = rg.Transform.PlaneToPlane(rg.Plane.WorldXY, ee_frame)
                    acm.Transform(trans)
                    vec = ee_frame.Normal
                    vec.Unitize()
                    vec *= t0cf_2_tcp
                    trans2 = rg.Transform.Translation(-vec)
                    acm.Transform(trans2)
        return (
            visual,
            collision,
            collision_meshes,
            acm,
            frames,
            base_frame,
            ee_frame,
        )
# ---------- end robot_visualize ----------
mesh = Mesh(robot_visualize.attached_meshes)  # disabled

# ----
# EXPORT
panel_4 = Panel("robotA")
approach_placing_plane_robota = Plane(Plane(origin=(0.3943346491, 0.04049411799, 0.3676446038), x=(-0.024578009, -0.0007541304728, 0.9996976307), y=(0.3137178998, -0.9494904562, 0.006996637247)))
robota_approach_place_config = Data()
robota_pick_approach_config = Data()
robota_place_plane = Plane()
export = Button()
robota_pickup_plane = Plane()
concatenate = Concatenate(FragmentA=panel_4)
send = GhPythonScript(
    approach_pickup_config=robota_pick_approach_config,
    approach_place_plane=approach_placing_plane_robota,
    pickup_plane=robota_pickup_plane,
    approach_place_config=robota_approach_place_config,
    place_plane=robota_place_plane,
    export=export,
    speed=Slider(83, range=0..83),
    file_name="robotA_place_stick00",
    selected_robot=concatenate)  # -> actions; inputs approach_place_plane: Plane, pickup_plane: Plane, configurations_pick_to_place: list
# ---------- send: Python ----------
from datetime import datetime as dt
import os
import compas
import sys
from compas_rhino import unload_modules
from compas_rhino.conversions import RhinoPlane, RhinoMesh
from compas.geometry import Scale, Frame
from compas_fab.robots import Robot
from compas_ghpython.utilities import ghtree_to_list
import compas_rrc as rrc
import time
from compas_rhino.conversions import plane_to_compas_frame
import Rhino.Geometry as rg
import math


#set the folder path
HERE = ghenv.LocalScope.ghdoc.Path
DATA = os.path.abspath(os.path.join(HERE, '..', '..', 'data'))
now = dt.now().strftime("%Y%m%d_")
file_path = DATA + "/" + now + file_name + ".json"

path = DATA = os.path.abspath(os.path.join(HERE, '..', '..', 'process'))
if path not in sys.path:
    sys.path.append(path)

#set the scaling factor from meters to mm
scalefactor = 1000
S = Scale.from_factors([scalefactor] * 3)

unload_modules('production_data')
from production_data import Action, ProductionData

#initialize actions
actions = []


# Set the tool
actions.append(Action('SetTool', dict(tool_name='tool0'), action_id = 0))  #here we set the tcp to the flange of the robot
# Set work object
actions.append(Action('SetWorkObject', dict(wobj_name='wobj0'), action_id = 1))
id = 1

#print text on the teach pendant and wait for action
id +=1
actions.append(Action('PrintText', dict(text='Pickup Element?'), action_id = id))
id +=1
actions.append(Action('Stop', dict(), action_id = id))

#open gripper
id +=1
actions.append(Action('SetDigital', dict(io_name = 'XS14_1', value = 0),action_id = id))

#send above pickup position with configuration
joints = [math.degrees(j) for j in approach_pickup_config.joint_values]
id +=1
actions.append(Action('MoveToJoints', dict(joints = joints, ext_axes = [], speed=speed, zone= rrc.Zone.FINE, feedback_level=rrc.FeedbackLevel.DONE), action_id = id))

#send to pickup with linear movement (plane)
frame = plane_to_compas_frame(pickup_plane)
print(frame)
frame_rob = robot.from_tcf_to_t0cf([frame])[0]  #transform from Tcf to T0cf as we have not declared any tool
scaled_frame = frame_rob.transformed(S) #convert to mm again
print(scaled_frame) 
id +=1
actions.append(Action('MoveToFrame', dict(frame= scaled_frame, speed=speed, zone=rrc.Zone.FINE, motion_type='rrc.Motion.LINEAR',feedback_level=rrc.FeedbackLevel.DONE), action_id = id))

#wait
id +=1
actions.append(Action('WaitTime', dict(time = 1,  feedback_level=rrc.FeedbackLevel.DONE), action_id = id))

#close
id +=1
actions.append(Action('SetDigital', dict(io_name = 'XS14_1', value = 1),action_id = id))

#print text on the teach pendant and wait for action
id +=1
actions.append(Action('PrintText', dict(text='Move Element to position?'), action_id = id))
id +=1
actions.append(Action('Stop', dict(), action_id = id))

#wait

id +=1
actions.append(Action('WaitTime', dict(time = 1,  feedback_level=rrc.FeedbackLevel.DONE), action_id = id))


#config
#send above pickup with configuration
joints = [math.degrees(j) for j in approach_pickup_config.joint_values]
id +=1
actions.append(Action('MoveToJoints', dict(joints = joints, ext_axes = [], speed=speed, zone= rrc.Zone.FINE, feedback_level=rrc.FeedbackLevel.DONE), action_id = id))

#trajectory from approach pickup to approach place
for configuration in configurations_pick_to_place:
    temp = []
    print(configuration)
    for n,j in zip(configuration.joint_names,configuration.joint_values):
        if n == str(selected_robot)+"_joint_1":
            temp.append(j)
    for n,j in zip(configuration.joint_names,configuration.joint_values):
        if n == str(selected_robot)+"_joint_2":
            temp.append(j)
    for n,j in zip(configuration.joint_names,configuration.joint_values):
        if n == str(selected_robot)+"_joint_3":
            temp.append(j)
    for n,j in zip(configuration.joint_names,configuration.joint_values):
        if n == str(selected_robot)+"_joint_4":
            temp.append(j)
    for n,j in zip(configuration.joint_names,configuration.joint_values):
        if n == str(selected_robot)+"_joint_5":
            temp.append(j)
    for n,j in zip(configuration.joint_names,configuration.joint_values):
        if n == str(selected_robot)+"_joint_6":
            temp.append(j)

    joints = [math.degrees(j) for j in temp]
    print joints
    id +=1
    actions.append(Action('MoveToJoints', dict(joints = joints, ext_axes = [], speed=speed, zone= 5, feedback_level=rrc.FeedbackLevel.DONE), action_id = id))

#print text on the teach pendant and wait for action
id +=1
actions.append(Action('PrintText', dict(text='should the Robot place the element at the final position?'), action_id = id))
id +=1
actions.append(Action('Stop', dict(), action_id = id))

#place with plane
frame = plane_to_compas_frame(place_plane)
frame_rob = robot.from_tcf_to_t0cf([frame])[0]
scaled_frame = frame_rob.transformed(S)
id +=1
actions.append(Action('MoveToFrame', dict(frame= scaled_frame, speed=speed, zone=rrc.Zone.FINE, motion_type='rrc.Motion.LINEAR',feedback_level=rrc.FeedbackLevel.DONE), action_id = id))

#can I leave?
id +=1
actions.append(Action('PrintText', dict(text='Release element?'), action_id = id))
id +=1
actions.append(Action('Stop', dict(), action_id = id))

#open gripper
id +=1
actions.append(Action('SetDigital', dict(io_name = 'XS14_1', value = 0),action_id = id))

#wait
id +=1
actions.append(Action('WaitTime', dict(time = 0.5,  feedback_level=rrc.FeedbackLevel.DONE), action_id = id))

#send to approach place plane
frame = plane_to_compas_frame(approach_place_plane)
frame_rob = robot.from_tcf_to_t0cf([frame])[0]
scaled_frame = frame_rob.transformed(S)
id +=1
actions.append(Action('MoveToFrame', dict(frame= scaled_frame, speed=speed, zone=rrc.Zone.FINE, motion_type='rrc.Motion.LINEAR',feedback_level=rrc.FeedbackLevel.DONE), action_id = id))

#send above pickup with configuration
id +=1
actions.append(Action('PrintText', dict(text='Send Robot to pick up station?'), action_id = id))
id +=1
actions.append(Action('Stop', dict(), action_id = id))

#REVERSE?
for configuration in configurations_pick_to_place[::-1]:
    temp = []
    for n,j in zip(configuration.joint_names,configuration.joint_values):
        if n == str(selected_robot)+"_joint_1":
            temp.append(j)
    for n,j in zip(configuration.joint_names,configuration.joint_values):
        if n == str(selected_robot)+"_joint_2":
            temp.append(j)
    for n,j in zip(configuration.joint_names,configuration.joint_values):
        if n == str(selected_robot)+"_joint_3":
            temp.append(j)
    for n,j in zip(configuration.joint_names,configuration.joint_values):
        if n == str(selected_robot)+"_joint_4":
            temp.append(j)
    for n,j in zip(configuration.joint_names,configuration.joint_values):
        if n == str(selected_robot)+"_joint_5":
            temp.append(j)
    for n,j in zip(configuration.joint_names,configuration.joint_values):
        if n == str(selected_robot)+"_joint_6":
            temp.append(j)

    joints = [math.degrees(j) for j in temp]
    #print joints
    id +=1
    actions.append(Action('MoveToJoints', dict(joints = joints, ext_axes = [], speed=speed, zone= 5, feedback_level=rrc.FeedbackLevel.DONE), action_id = id))


production_data = ProductionData(actions)

if export:
    with open(file_path, 'w') as fp:
        compas.json_dump(production_data.to_data(), fp)
# ---------- end send ----------

# ----
# EXPORT
panel_5 = Panel("robotB")
pick_approach_config = Data()
approach_place_plane = Plane(Plane(origin=(0.3943346491, 0.04049411799, 0.3676446038), x=(-0.024578009, -0.0007541304728, 0.9996976307), y=(0.3137178998, -0.9494904562, 0.006996637247)))
approach_place_config = Data()
export_2 = Button()
pickup_plane = Plane()
place_plane = Plane()
concatenate_2 = Concatenate(FragmentA=panel_5)
send_2 = GhPythonScript(
    approach_pickup_config=pick_approach_config,
    approach_place_plane=approach_place_plane,
    pickup_plane=pickup_plane,
    approach_place_config=approach_place_config,
    place_plane=place_plane,
    export=export_2,
    speed=Slider(83, range=0..83),
    file_name="robotB_place_stick00",
    selected_robot=concatenate_2)  # -> actions; inputs approach_place_plane: Plane, pickup_plane: Plane, configurations_pick_to_place: list; same code as send

# ----
# approach pick config
# approach pick plane
# PLACE ROBOT B
# place plane
# place config
# approach place config
# approach place plane
relay_2 = Relay()  # disabled
list_item_2 = ListItem(List=relay_2, Index=0, Wrap=True)  # disabled
number_slider_5 = Slider(25, range=1..1000)  # disabled
run_2 = BooleanToggle(True)  # disabled
boolean_toggle_5 = BooleanToggle(False)  # disabled
boolean_toggle_6 = BooleanToggle(True)  # disabled
boolean_toggle_7 = BooleanToggle(True)  # disabled
boolean_toggle_8 = BooleanToggle(True)  # disabled
panel_6 = Panel("robot_B")  # disabled

# ----
# MOTION PLANNING B
# attached element
panel_7 = Panel("robot_B")  # disabled

ghpython_script_2 = GhPythonScript(conf=list_item_2, group=panel_7)  # -> out, a; disabled; same code as ghpython_script
merge_2 = Merge(Data1=flatten(relay_2), Data2=flatten(ghpython_script_2.a))  # disabled
list_length_2 = ListLength(List=merge_2)  # disabled
python_2 = PythonScript(Run=run_2, Target=list_length_2, Interval=number_slider_5)  # -> Counter; inputs Run: Boolean; disabled; same code as python
item_2 = ListItem(List=merge_2, Index=python_2, Wrap=True)  # disabled
panel_8 = Panel(python_2)  # disabled
robot_visualize_2 = RobotVisualize(
    group=panel_6,
    configuration=item_2,
    show_frames=boolean_toggle_5,
    show_end_effector_frame=boolean_toggle_6,
    show_cm=boolean_toggle_7,
    show_acm=boolean_toggle_8)  # -> visual, collision, collision_meshes, attached_meshes, frames, base_frame, ee_frame; inputs acm: Mesh, show_visual: Boolean, show_collision: Boolean, show_frames: Boolean, show_base_frame: Boolean, show_end_effector_frame: Boolean, show_cm: Boolean, show_acm: Boolean; disabled; same code as robot_visualize
mesh_2 = Mesh(robot_visualize_2.attached_meshes)  # disabled

geometry = Geometry(robot_visualize_2.ee_frame)  # disabled
